# Grasshopper definition HiroshimaTest.ghx (Grasshopper 1.0.7)
# plug-ins: Pufferfish

# ---- group: input
Z = Slider(797.546, range=0..10000)
dist_weigth = Slider(0.319, range=0..1)
extrusion_height = Slider(0.035, range=0..1)
random_seed = Slider(15.95, range=0..100)
explosion_center_point = Point(<point referenced from the Rhino model>)
pointorigo = Point(Point(552, -6056, 0))
high_point = Point(<point referenced from the Rhino model>)
pointright = Point(<point referenced from the Rhino model>)
high_point_2 = Point(<point referenced from the Rhino model>)
pointleft = Point(<point referenced from the Rhino model>)
surface = Surface([<surface referenced from the Rhino model> x662])

# ----
deconstruct_brep = DeconstructBrep(Brep=surface)  # -> Faces, Edges, Vertices
circle_3pt = Circle3Pt(PointA=high_point, PointB=explosion_center_point, PointC=high_point_2)  # -> Circle, Plane, Radius
plane_3pt = Plane3Pt(PointA=high_point_2, PointB=explosion_center_point, PointC=high_point)
join_curves = JoinCurves(Curves=deconstruct_brep.Edges, Preserve=False)
closed = Closed(Curve=join_curves)  # -> Closed, Periodic
dispatch = Dispatch(List=join_curves, DispatchPattern=closed.Closed)  # -> ListA, ListB
deconstruct_box = DeconstructBox(Box=dispatch.ListA)  # -> Plane, X, Y, Z
area = Area(Geometry=dispatch.ListA)  # -> Area, Centroid
integer = Integer(deconstruct_box.X)
multiplication = Multiplication(A=area.Centroid, B=random_seed)
panel = Panel(deconstruct_box.X)
division = Division(A=1, B=integer)
integer_2 = Integer(multiplication)
random = Random(Range=division, Number=1, Seed=integer_2)  # -> flatten(Random)
multiplication_2 = Multiplication(A=Z, B=division)
multiplication_3 = Multiplication(A=random, B=10000)
multiplication_4 = Multiplication(A=multiplication_2, B=10000)
distance = Distance(PointA=area.Centroid, PointB=explosion_center_point)
random_2 = Random(Range=Z, Number=1, Seed=multiplication_3)
multiplication_5 = Multiplication(A=random_2, B=distance, C=dist_weigth, D="0.001")
path_mapper = PathMapper(multiplication_5, source="{A;B;C}", target="{A;B}")
panel_2 = Panel(multiplication_5)
unit_z = UnitZ(Factor=path_mapper)
move = Move(Geometry=dispatch.ListA, Motion=unit_z)  # -> Geometry, Transform
area_2 = Area(Geometry=move.Geometry)  # -> Area, Centroid
unit_x = UnitX(Factor=1)
vector_2pt = Vector2Pt(PointA=pointorigo, PointB=pointright, Unitize=False)  # -> Vector, Length
vector_2pt_2 = Vector2Pt(PointA=pointorigo, PointB=pointleft, Unitize=False)  # -> Vector, Length
vector_2pt_3 = Vector2Pt(PointA=pointorigo, PointB=area.Centroid, Unitize=False)  # -> Vector, Length
plane_3pt_2 = Plane3Pt(PointA=pointorigo, PointB=pointright, PointC=pointleft)
point_plane_side = PointPlaneSide(Point=area_2.Centroid, Plane=plane_3pt_2)  # -> Side, Front, Back, Distance
angle = Angle(VectorA=vector_2pt.Vector, VectorB=unit_x)  # -> Angle, Reflex
angle_2 = Angle(VectorA=vector_2pt_3.Vector, VectorB=unit_x)  # -> Angle, Reflex
angle_3 = Angle(VectorA=vector_2pt_2.Vector, VectorB=unit_x)  # -> Angle, Reflex
evaluate = Evaluate(Expression="(aMin < a) and (a < aMax)", aMin=angle.Angle, a=angle_2.Angle, aMax=angle_3.Angle)
gate_and = GateAnd(A=evaluate, B=point_plane_side.Back)
dispatch_2 = Dispatch(List=move.Geometry, DispatchPattern=gate_and)  # -> ListA, ListB
panel_3 = Panel(gate_and)
unit_z_2 = UnitZ(Factor=1)
line_sdl = LineSDL(Start=area.Centroid, Direction=unit_z_2, Length=1)
line_plane = LinePlane(Line=line_sdl, Plane=plane_3pt_2)  # -> Point, ParamL, ParamP
vector_2pt_4 = Vector2Pt(PointA=area.Centroid, PointB=line_plane.Point, Unitize=False)  # -> Vector, Length
move_2 = Move(Geometry=dispatch_2.ListA, Motion=vector_2pt_4.Vector)  # -> Geometry, Transform
unit_z_3 = UnitZ(Factor=extrusion_height)
relay = Relay([move_2.Geometry, dispatch_2.ListB])
area_3 = Area(Geometry=relay)  # -> Area, Centroid
control_points = ControlPoints(Curve=relay)  # -> Points, Weights, Knots
point_plane_side_2 = PointPlaneSide(Point=area_3.Centroid, Plane=plane_3pt)  # -> Side, Front, Back, Distance
dispatch_3 = Dispatch(List=relay, DispatchPattern=point_plane_side_2.Front)  # -> ListA, ListB
panel_4 = Panel(move_2.Geometry)
extrude = Extrude(Base=dispatch_3.ListA, Direction=unit_z_3)

# ---- group: Output
cap_holes = CapHoles(Brep=extrude)
