# Grasshopper definition Graft.ghx (Grasshopper 1.0.7)

ghpython_script = GhPythonScript()  # -> out, a
# ---------- ghpython_script: Python ----------
__author__ = "samu.karli"
__version__ = "2022.05.19"

from Grasshopper import DataTree as Tree
import Grasshopper as gh
from System import Array

a = Tree[object]()

import rhinoscriptsyntax as rs
p = gh.Kernel.Data.GH_Path(0)

for i in range (100):
   a.Add(i, p)
# ---------- end ghpython_script ----------
ghpython_script_2 = GhPythonScript(x=ghpython_script.a)  # -> out, a; inputs x: tree
# ---------- ghpython_script_2: Python ----------
__author__ = "samu.karli"
__version__ = "2022.05.19"

from Grasshopper import DataTree as Tree
import Grasshopper as gh
from System import Array

a = Tree[object]()

import rhinoscriptsyntax as rs

branchList = x.Branch(0)

i = 0

for j in range(0, len(branchList), 4):
    p = gh.Kernel.Data.GH_Path(0, i)

    a.Add(branchList[j], p)
    a.Add(branchList[j+1], p)
    a.Add(branchList[j+2], p)
    a.Add(branchList[j+3], p)
    i += 1
# ---------- end ghpython_script_2 ----------
panel = Panel(ghpython_script.a)
panel_2 = Panel(ghpython_script_2.a)
