# Grasshopper definition MinBoundBox3d.ghx (Grasshopper 1.0.7)
# plug-ins: Grasshopper-ARCHICAD Live Connection built for Rhinoceros 7

beam = Beam([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])
roof = Roof([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])
deconstruct_beam = DeconstructBeam(
    Beam=beam,
    SurfaceType0_SurfaceType=(1, 0, 0),
    SurfaceType1_SurfaceType=(1, 0, 0),
    SurfaceType2_SurfaceType=(1, 0, 0),
    SurfaceType3_SurfaceType=(1, 0, 0),
    SurfaceType4_SurfaceType=(1, 0, 0),
    SurfaceType5_SurfaceType=(1, 0, 0),
    SurfaceType6_SurfaceType=(1, 0, 0),
    SurfaceType7_SurfaceType=(1, 0, 0),
    SurfaceType8_SurfaceType=(1, 0, 0),
    SurfaceType9_SurfaceType=(1, 0, 0))  # -> Curve, Brep, BeamSettings
deconstruct_roof = DeconstructRoof(
    RoofSinglePlane=roof,
    SurfaceType0_SurfaceType=(1, 0, 0),
    SurfaceType1_SurfaceType=(1, 0, 0),
    SurfaceType2_SurfaceType=(1, 0, 0),
    SurfaceType3_SurfaceType=(1, 0, 0),
    SurfaceType4_SurfaceType=(1, 0, 0),
    SurfaceType5_SurfaceType=(1, 0, 0),
    SurfaceType6_SurfaceType=(1, 0, 0),
    SurfaceType7_SurfaceType=(1, 0, 0),
    SurfaceType8_SurfaceType=(1, 0, 0),
    SurfaceType9_SurfaceType=(1, 0, 0),
    SurfaceType10_SurfaceType=(1, 0, 0),
    SurfaceType11_SurfaceType=(1, 0, 0),
    SurfaceType12_SurfaceType=(1, 0, 0),
    SurfaceType13_SurfaceType=(1, 0, 0),
    SurfaceType14_SurfaceType=(1, 0, 0),
    SurfaceType15_SurfaceType=(1, 0, 0),
    SurfaceType16_SurfaceType=(1, 0, 0),
    SurfaceType17_SurfaceType=(1, 0, 0))  # -> Polygon, Brep, RoofSettings
panel = Panel("C:\Users\jozsef.szilagyi\Desktop\fejlesztések\GH\Release\GrashopperPythonScripts\MinBoundBox3d.py")
geometry = Geometry(<missing>)
irandomedge = Slider(1, range=0..10)
epsilon = Slider(0.001, range=0.0001..1)
stepvolume = Slider(2, range=1..20)
stepplanar = Slider(17, range=2..20)
stepdivider = Slider(3, range=2..10)
imaxiteration = Slider(30, range=1..10000)
dodrawiterationboxes = BooleanToggle(False)
wall = Wall(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)
isboundaryopt = BooleanToggle(False)
deconstruct_wall = DeconstructWall(
    Wall=wall,
    SurfaceType0_SurfaceType=(1, 0, 0),
    SurfaceType1_SurfaceType=(1, 0, 0),
    SurfaceType2_SurfaceType=(1, 0, 0),
    SurfaceType3_SurfaceType=(1, 0, 0),
    SurfaceType4_SurfaceType=(1, 0, 0),
    SurfaceType5_SurfaceType=(1, 0, 0),
    SurfaceType6_SurfaceType=(1, 0, 0),
    SurfaceType7_SurfaceType=(1, 0, 0),
    SurfaceType8_SurfaceType=(1, 0, 0),
    SurfaceType9_SurfaceType=(1, 0, 0),
    SurfaceType10_SurfaceType=(1, 0, 0),
    SurfaceType11_SurfaceType=(1, 0, 0))  # -> Curve, Brep, WallSettings
test = BooleanToggle(False)
integer = Integer(stepvolume)
integer_2 = Integer(stepplanar)
integer_3 = Integer(stepdivider)
wall_2 = Wall([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])
deconstruct_wall_2 = DeconstructWall(
    Wall=wall_2,
    SurfaceType0_SurfaceType=(1, 0, 0),
    SurfaceType1_SurfaceType=(1, 0, 0),
    SurfaceType2_SurfaceType=(1, 0, 0),
    SurfaceType3_SurfaceType=(1, 0, 0),
    SurfaceType4_SurfaceType=(1, 0, 0),
    SurfaceType5_SurfaceType=(1, 0, 0),
    SurfaceType6_SurfaceType=(1, 0, 0),
    SurfaceType7_SurfaceType=(1, 0, 0),
    SurfaceType8_SurfaceType=(1, 0, 0),
    SurfaceType9_SurfaceType=(1, 0, 0),
    SurfaceType10_SurfaceType=(1, 0, 0),
    SurfaceType11_SurfaceType=(1, 0, 0))  # -> Curve, Brep, WallSettings
slab = Slab([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])
deconstruct_slab = DeconstructSlab(
    Slab=slab,
    SurfaceType0_SurfaceType=(1, 0, 0),
    SurfaceType1_SurfaceType=(1, 0, 0),
    SurfaceType2_SurfaceType=(1, 0, 0),
    SurfaceType3_SurfaceType=(1, 0, 0),
    SurfaceType4_SurfaceType=(1, 0, 0),
    SurfaceType5_SurfaceType=(1, 0, 0))  # -> Polygon, Brep, SlabSettings
column = Column([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])
deconstruct_column = DeconstructColumn(
    Column=column,
    SurfaceType0_SurfaceType=(1, 0, 0),
    SurfaceType1_SurfaceType=(1, 0, 0),
    SurfaceType2_SurfaceType=(1, 0, 0),
    SurfaceType3_SurfaceType=(1, 0, 0),
    SurfaceType4_SurfaceType=(1, 0, 0),
    SurfaceType5_SurfaceType=(1, 0, 0),
    SurfaceType6_SurfaceType=(1, 0, 0),
    SurfaceType7_SurfaceType=(1, 0, 0),
    SurfaceType8_SurfaceType=(1, 0, 0))  # -> AnchorPoint, EndPoint, Brep, ColumnSettings
file_path = FilePath(panel)
minimum_bounding_box = GhPythonScript(
    Code=file_path,
    IsTest=test,
    Selection=[deconstruct_wall_2.Brep, deconstruct_slab.Brep, deconstruct_column.Brep, deconstruct_beam.Brep],
    Epsilon=0.001,
    IsBoundaryOpt=isboundaryopt,
    IStepVolume=integer,
    IStepPlanar=integer_2,
    IStepDivider=integer_3,
    IMaxIteration=imaxiteration,
    IRandomEdge=irandomedge,
    DoDrawIterationBoxes=dodrawiterationboxes)  # -> Out, Result
panel_2 = Panel(geometry)
panel_3 = Panel(minimum_bounding_box.Result)
panel_4 = Panel(minimum_bounding_box.Out)
