# Grasshopper definition Poroszsüveg generátor.ghx (Grasshopper 1.0.7)
# plug-ins: treesloth01, Grasshopper-ARCHICAD Live Connection built for Rhinoceros 6, Wombat

panel = Panel("L:\03_szervezeti_egysegek\09_bim\11_Fejlesztesek\Poroszsüveg_generátor\UPN(15).csv")
panel_2 = Panel("L:\03_szervezeti_egysegek\09_bim\11_Fejlesztesek\Poroszsüveg_generátor\IPECSV.csv")
szerkezet_magasság = Slider(500, range=0..1000)

boltozat_magasság = Slider(300, range=0..1000)
tégla_vastagság = Slider(120, range=0..500)
profile = Profile()
szinkron = BooleanToggle(True)
text = Text(panel)

gerenda_felfekvés = Slider(120, range=0..500)

# ---- group: AC profil
profile_2 = Profile()

# ----
file_path = FilePath(panel_2)

# ---- group: Gerendák
_2d_curve = _2DCurve([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])

# ---- group: Födém kontúr
_2d_curve_2 = _2DCurve(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)

# ----
ipe_beam = IPEBeam(ipe_profile=profile_2, file_path=file_path)  # -> profil_2, t_talpmagasság_2, h_magasság_2
extend_curve = ExtendCurve(Curve=_2d_curve, Type=0, Start=gerenda_felfekvés, End=gerenda_felfekvés)
curve = Curve(_2d_curve_2)
curve_2 = Curve(extend_curve)
unit_settings = GhPythonScript()  # -> out, a
# ---------- unit_settings: Python ----------
import rhinoscriptsyntax as rs
import Rhino


if Rhino.RhinoDoc.ActiveDoc.ModelUnitSystem.ToString() == "Meters":
    a = 1
elif Rhino.RhinoDoc.ActiveDoc.ModelUnitSystem.ToString() == "Centimeters":
    a = 100
else:
    a = 1000
# ---------- end unit_settings ----------
division = Division(A=1, B=unit_settings.a)
multiplication = Multiplication(A=division, B=1000)
scale = Scale(Geometry=ipe_beam.profil_2, Center=Point(0, 0, 0), Factor=multiplication)  # -> Geometry, Transform
multiplication_2 = Multiplication(A=multiplication, B=ipe_beam.h_magasság_2)
number = Number(tégla_vastagság)
number_2 = Number(boltozat_magasság)
number_3 = Number(ipe_beam.t_talpmagasság_2)
division_2 = Division(A=multiplication_2, B=2)

# ---- group: DWG profil
curve_3 = Curve(scale.Geometry)

# ---- group: Arcs
end_points = EndPoints(Curve=curve_2)  # -> Start, End
draw_arch = DrawArch(points=end_points.Start, number=number_2, number_2=number_3)  # -> points_2, geometry
unit_z = UnitZ(Factor=number)
draw_arch_2 = DrawArch(points=end_points.End, number=number_2, number_2=number_3)  # -> points_2, geometry
loft = Loft(
    Curves=[draw_arch.geometry, draw_arch_2.geometry],
    Options={Adjust=False, Closed=False, LoftEnds=0, LoftSimp=0, LoftType=0, Rebuild=10, Refit=0.01})
extrude = Extrude(Base=loft, Direction=unit_z)

# ----
curve_4 = Curve(curve_2)
addition = Addition(A=boltozat_magasság, B=tégla_vastagság)
unit_z_2 = UnitZ(Factor=division_2)
multiplication_3 = Multiplication(A=addition, B=-1.1)
unit_z_3 = UnitZ(Factor=5000)
unit_z_4 = UnitZ(Factor=szerkezet_magasság)
unit_z_5 = UnitZ(Factor=multiplication_3)
unit_z_6 = UnitZ(Factor=tégla_vastagság)
surface = Surface(curve)
extrude_2 = Extrude(Base=curve, Direction=unit_z_4)
area = Area(Geometry=surface)  # -> Area, Centroid
extrude_3 = Extrude(Base=surface, Direction=unit_z_3)
extrude_4 = Extrude(Base=loft, Direction=unit_z_5)
unit_z_7 = UnitZ(Factor=-100)
move = Move(Geometry=extrude_3, Motion=unit_z_7)  # -> Geometry, Transform
move_2 = Move(Geometry=extrude_4, Motion=unit_z_6)  # -> flatten(Geometry), Transform
cap_holes = CapHoles(Brep=extrude_2)
solid_intersection = SolidIntersection(BrepsA=extrude, BrepsB=move.Geometry)
scale_2 = Scale(Geometry=surface, Center=area.Centroid, Factor=10)  # -> Geometry, Transform
unit_z_8 = UnitZ(Factor=-3000)
solid_difference = SolidDifference(BrepsA=cap_holes, BrepsB=move_2.Geometry)
extrude_5 = Extrude(Base=scale_2.Geometry, Direction=unit_z_8)
solid_difference_2 = SolidDifference(BrepsA=solid_intersection, BrepsB=extrude_5)

# ---- group: Outer Beams
upn_beam = UPNBeam(text=profile, file_path=text)  # -> profil_2, t_talpmagasság_2, szélesség_2, magasság_2
first_last = FirstLast(list=extend_curve)  # -> first_value_2, last_value_2
scale_3 = Scale(Geometry=upn_beam.profil_2, Center=Point(0, 0, 0), Factor=multiplication)  # -> Geometry, Transform
szélprofil = Geometry(scale_3.Geometry)
division_3 = Division(A=upn_beam.magasság_2, B=2)
unit_z_9 = UnitZ(Factor=division_3)
xy_plane = XYPlane(Origin=Point(0, 0, 0))

# ---- group: Outer Beams / Külső gerendák
curve_5 = Curve([first_last.first_value_2, first_last.last_value_2])

# ---- group: Outer Beams (continued)
split_list = SplitList(List=curve_5, Index=1)  # -> ListA, ListB
end_points_2 = EndPoints(Curve=split_list.ListB)  # -> Start, End
end_points_3 = EndPoints(Curve=split_list.ListA)  # -> Start, End
curve_closest_point = CurveClosestPoint(Point=end_points_3.Start, Curve=split_list.ListB)  # -> Point, Parameter, Distance
curve_closest_point_2 = CurveClosestPoint(Point=end_points_2.Start, Curve=split_list.ListA)  # -> Point, Parameter, Distance
vector_2pt = Vector2Pt(PointA=end_points_3.Start, PointB=curve_closest_point.Point, Unitize=False)  # -> Vector, Length
vector_2pt_2 = Vector2Pt(PointA=end_points_3.Start, PointB=end_points_3.End, Unitize=False)  # -> Vector, Length
vector_2pt_3 = Vector2Pt(PointA=end_points_2.Start, PointB=end_points_2.End, Unitize=False)  # -> Vector, Length
vector_2pt_4 = Vector2Pt(PointA=end_points_2.Start, PointB=curve_closest_point_2.Point, Unitize=False)  # -> Vector, Length
construct_plane = ConstructPlane(Origin=end_points_3.Start, XAxis=vector_2pt.Vector, YAxis=vector_2pt_2.Vector)
construct_plane_2 = ConstructPlane(Origin=end_points_2.Start, XAxis=vector_2pt_4.Vector, YAxis=vector_2pt_3.Vector)
relay = Relay([construct_plane_2, construct_plane])
deconstruct_plane = DeconstructPlane(Plane=relay)  # -> Origin, XAxis, YAxis, ZAxis
deconstruct_vector = DeconstructVector(Vector=deconstruct_plane.ZAxis)  # -> XComponent, YComponent, ZComponent
midpoint = Midpoint(Curve=curve_5)
smaller_than = SmallerThan(FirstNumber=deconstruct_vector.ZComponent, SecondNumber=0)  # -> SmallerThan, OrEqualTo
plane_normal = PlaneNormal(Origin=midpoint, ZAxis=curve_5)
unweave = Unweave(List=curve_5, UnweavePattern=smaller_than.SmallerThan)  # -> Data0, Data1
unweave_2 = Unweave(List=relay, UnweavePattern=smaller_than.SmallerThan)  # -> Data0, Data1
mirror = Mirror(Geometry=unweave.Data0, Plane=plane_normal)  # -> Geometry, Transform
flip_plane = FlipPlane(Plane=unweave_2.Data1, ReverseX=False, ReverseY=True, SwapAxes=False)
move_3 = Move(Geometry=[unweave.Data1, mirror.Geometry], Motion=unit_z_9)  # -> flatten(Geometry), Transform
orient = Orient(Geometry=szélprofil, Source=xy_plane, Target=[flip_plane, unweave_2.Data0])  # -> Geometry, Transform
extrude_6 = Extrude(Base=orient.Geometry, Direction=vector_2pt_2.Vector)
cap_holes_2 = CapHoles(Brep=extrude_6)

# ---- group: OUTPUT
morph_settings = MorphSettings(BuildingMaterial=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, Layer=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)
beamsetp = BeamSettingsProfile(Profile=profile_2, Profile_2=profile_2, AC_ActiveState_Name="Profile")
beamsetp_2 = BeamSettingsProfile(Profile=profile, Profile_2=profile, AC_ActiveState_Name="Profile")
beam = Beam(Synchronize=szinkron, Curve=move_3.Geometry, BeamSettings=beamsetp_2)

# ---- group: Inner Beams
split_list_2 = SplitList(List=curve_4, Index=1)  # -> ListA, ListB
split_list_3 = SplitList(List=draw_arch.points_2, Index=1)  # -> ListA, ListB
split_list_4 = SplitList(List=reverse(split_list_2.ListB), Index=1)  # -> ListA, ListB
split_list_5 = SplitList(List=reverse(split_list_3.ListB), Index=1)  # -> ListA, ListB
move_4 = Move(Geometry=curve_3, Motion=split_list_5.ListB)  # -> Geometry, Transform

# ----
move_5 = Move(Geometry=move_4.Geometry, Motion=unit_z_2)  # -> Geometry, Transform

# ---- group: Inner Beams (continued)
extrude_along = ExtrudeAlong(Base=move_5.Geometry, Curve=split_list_4.ListB)
cap_holes_3 = CapHoles(Brep=extrude_along)

# ----
solid_difference_3 = SolidDifference(BrepsA=solid_difference_2, BrepsB=[cap_holes_3, cap_holes_2])
move_6 = Move(Geometry=[move_4.Geometry, split_list_4.ListB], Motion=unit_z_2)  # -> Geometry, Transform

# ---- group: OUTPUT (continued)
beam_2 = Beam(Synchronize=szinkron, Curve=move_6.Geometry, BeamSettings=beamsetp)
morph_solid = MorphSolid(Synchronize=szinkron, Mesh=[solid_difference_3, solid_difference], MorphSettings=morph_settings)

# ==== cluster IPEBeam
file_path = ClusterInput()
file_path_2 = FilePath(file_path)
read_file = ReadFile(File=file_path_2, PerLineParse=True)
split_list = SplitList(List=read_file, Index=1)  # -> ListA, ListB
text_split = TextSplit(Text=split_list.ListB, Separators=",")
ipe_profile = ClusterInput()
ipe_profile_2 = Text(ipe_profile)
list_item = ListItem(List=text_split, Index=1, Wrap=True)  # -> flatten(Item)
panel = Panel(text_split)
b = ListItem(List=text_split, Index=3, Wrap=True)  # -> flatten(Item)
s = ListItem(List=text_split, Index=4, Wrap=True)  # -> flatten(Item)
t = ListItem(List=text_split, Index=5, Wrap=True)  # -> flatten(Item)
h = ListItem(List=text_split, Index=2, Wrap=True)  # -> flatten(Item)
member_index = MemberIndex(Set=list_item, Member=ipe_profile_2)  # -> Index, Count
list_item_2 = ListItem(List=h, Index=member_index.Index, Wrap=True)  # -> flatten(Item)
list_item_3 = ListItem(List=s, Index=member_index.Index, Wrap=True)  # -> flatten(Item)
list_item_4 = ListItem(List=t, Index=member_index.Index, Wrap=True)  # -> flatten(Item)
list_item_5 = ListItem(List=b, Index=member_index.Index, Wrap=True)  # -> flatten(Item)
division = Division(A=list_item_5, B=2)
division_2 = Division(A=list_item_3, B=2)
addition = Addition(A=division, B=division_2)
subtraction = Subtraction(A=division, B=division_2)
subtraction_2 = Subtraction(A=list_item_2, B=list_item_4)
construct_point = ConstructPoint(XCoordinate=0, YCoordinate=0, ZCoordinate=0)
construct_point_2 = ConstructPoint(XCoordinate=list_item_5, YCoordinate=0, ZCoordinate=0)
construct_point_3 = ConstructPoint(XCoordinate=list_item_5, YCoordinate=0, ZCoordinate=list_item_4)
construct_point_4 = ConstructPoint(XCoordinate=addition, YCoordinate=0, ZCoordinate=list_item_4)
construct_point_5 = ConstructPoint(XCoordinate=addition, YCoordinate=0, ZCoordinate=subtraction_2)
construct_point_6 = ConstructPoint(XCoordinate=list_item_5, YCoordinate=0, ZCoordinate=subtraction_2)
construct_point_7 = ConstructPoint(XCoordinate=list_item_5, YCoordinate=0, ZCoordinate=list_item_2)
construct_point_8 = ConstructPoint(XCoordinate=0, YCoordinate=0, ZCoordinate=list_item_2)
construct_point_9 = ConstructPoint(XCoordinate=0, YCoordinate=0, ZCoordinate=subtraction_2)
construct_point_10 = ConstructPoint(XCoordinate=subtraction, YCoordinate=0, ZCoordinate=subtraction_2)
construct_point_11 = ConstructPoint(XCoordinate=subtraction, YCoordinate=0, ZCoordinate=list_item_4)
construct_point_12 = ConstructPoint(XCoordinate=0, YCoordinate=0, ZCoordinate=list_item_4)
construct_point_13 = ConstructPoint(XCoordinate=0, YCoordinate=0, ZCoordinate=0)
negative = Negative(Value=division)
polyline = PolyLine(
    Vertices=[construct_point, construct_point_2, construct_point_3, construct_point_4, construct_point_5, construct_point_6, construct_point_7, construct_point_8, construct_point_9, construct_point_10, construct_point_11, construct_point_12, construct_point_13],
    Closed=False)
unit_x = UnitX(Factor=negative)
move = Move(Geometry=polyline, Motion=unit_x)  # -> Geometry, Transform
t_talpmagasság = Number(list_item_4)
h_magasság = Number(list_item_2)
profil = Curve(move.Geometry)
h_magasság_2 = ClusterOutput(h_magasság)
profil_2 = ClusterOutput(profil)
t_talpmagasság_2 = ClusterOutput(t_talpmagasság)

# ==== cluster DrawArch
points = ClusterInput()
number = ClusterInput()
number_2 = ClusterInput()
number_3 = Number(number_2)
number_4 = Number(number)
sort_points = SortPoints(Points=points)  # -> Points, Indices
ghpython_script = GhPythonScript(x=sort_points.Points)  # -> a; inputs x: list
# ---------- ghpython_script: Python ----------
__author__ = "jozsef.szilagyi"
__version__ = "2021.06.02"

import rhinoscriptsyntax as rs

L_Points = x
I_ListLength = len(L_Points)
OutList = []
checkPoint = 0

while checkPoint < I_ListLength-1:
    Point1 = L_Points[checkPoint]
    Point2 = L_Points[checkPoint+1]
    OutList.append(Point1)
    OutList.append(Point2)
    checkPoint = checkPoint+1

a = OutList
# ---------- end ghpython_script ----------
partition_list = PartitionList(List=ghpython_script, Size=2)
unit_z = UnitZ(Factor=number_4)
list_item = ListItem(List=partition_list, Index=0, Wrap=True)  # -> Item, Item1
tween_2p = Tween2P(point_a=list_item.Item, point_b=list_item.Item1, factor=0.5)
vector_2pt = Vector2Pt(PointA=list_item.Item, PointB=list_item.Item1, Unitize=True)  # -> Vector, Length
move = Move(Geometry=tween_2p, Motion=unit_z)  # -> Geometry, Transform
arc_3pt = Arc3Pt(PointA=list_item.Item, PointB=move.Geometry, PointC=list_item.Item1)  # -> Arc, Plane, Radius
create_set = CreateSet(List=number_3)  # -> Set, Map
division = Division(A=create_set.Set, B=2)
multiplication = Multiplication(A=number_4, B=10)
multiplication_2 = Multiplication(A=vector_2pt.Vector, B=division)
unit_z_2 = UnitZ(Factor=multiplication)
move_2 = Move(Geometry=list_item.Item, Motion=multiplication_2)  # -> simplify(Geometry), Transform
panel = Panel(multiplication_2)
move_3 = Move(Geometry=move_2.Geometry, Motion=unit_z_2)  # -> simplify(Geometry), Transform
line = Line(StartPoint=move_2.Geometry, EndPoint=move_3.Geometry)
curve_curve = CurveCurve(CurveA=arc_3pt.Arc, CurveB=line)  # -> Points, ParamsA, ParamsB
vector_2pt_2 = Vector2Pt(PointA=curve_curve.Points, PointB=move_2.Geometry, Unitize=False)  # -> Vector, Length
unit_z_3 = UnitZ(Factor=number_3)
move_4 = Move(Geometry=arc_3pt.Arc, Motion=vector_2pt_2.Vector)  # -> Geometry, Transform
move_5 = Move(Geometry=move_4.Geometry, Motion=unit_z_3)  # -> Geometry, Transform
geometry = ClusterOutput(move_5.Geometry)
points_2 = ClusterOutput(sort_points.Points)

# ==== cluster FirstLast
list = ClusterInput()
list_2 = Data(list)
list_item = ListItem(List=list_2, Index=0, Wrap=True)  # -> Item1, Item
first_value = Data(list_item.Item)
last_value = Data(list_item.Item1)
first_value_2 = ClusterOutput(first_value)
last_value_2 = ClusterOutput(last_value)

# ==== cluster UPNBeam
file_path = ClusterInput()
text = ClusterInput()
file_path_2 = FilePath(file_path)
text_2 = Text(text)
read_file = ReadFile(File=file_path_2, PerLineParse=True)
split_list = SplitList(List=read_file, Index=1)  # -> ListA, ListB
text_split = TextSplit(Text=split_list.ListB, Separators=",")
list_item = ListItem(List=text_split, Index=1, Wrap=True)  # -> flatten(Item)
member_index = MemberIndex(Set=list_item, Member=text_2)  # -> Index, Count
h = ListItem(List=text_split, Index=2, Wrap=True)  # -> flatten(Item)
b = ListItem(List=text_split, Index=3, Wrap=True)  # -> flatten(Item)
tw = ListItem(List=text_split, Index=4, Wrap=True)  # -> flatten(Item)
tf = ListItem(List=text_split, Index=5, Wrap=True)  # -> flatten(Item)
list_item_2 = ListItem(List=h, Index=member_index.Index, Wrap=True)  # -> flatten(Item)
list_item_3 = ListItem(List=b, Index=member_index.Index, Wrap=True)  # -> flatten(Item)
list_item_4 = ListItem(List=tw, Index=member_index.Index, Wrap=True)  # -> flatten(Item)
list_item_5 = ListItem(List=tf, Index=member_index.Index, Wrap=True)  # -> flatten(Item)
addition = Addition(B=list_item_4)
subtraction = Subtraction(A=list_item_2, B=list_item_5)
construct_point = ConstructPoint(XCoordinate=0, YCoordinate=0, ZCoordinate=0)
construct_point_2 = ConstructPoint(XCoordinate=list_item_3, YCoordinate=0, ZCoordinate=0)
construct_point_3 = ConstructPoint(XCoordinate=list_item_3, YCoordinate=0, ZCoordinate=list_item_5)
construct_point_4 = ConstructPoint(XCoordinate=addition, YCoordinate=0, ZCoordinate=list_item_5)
construct_point_5 = ConstructPoint(XCoordinate=addition, YCoordinate=0, ZCoordinate=subtraction)
construct_point_6 = ConstructPoint(XCoordinate=list_item_3, YCoordinate=0, ZCoordinate=subtraction)
construct_point_7 = ConstructPoint(XCoordinate=list_item_3, YCoordinate=0, ZCoordinate=list_item_2)
construct_point_8 = ConstructPoint(XCoordinate=0, YCoordinate=0, ZCoordinate=list_item_2)
construct_point_9 = ConstructPoint(XCoordinate=0, YCoordinate=0, ZCoordinate=0)
polyline = PolyLine(
    Vertices=[construct_point, construct_point_2, construct_point_3, construct_point_4, construct_point_5, construct_point_6, construct_point_7, construct_point_8, construct_point_9],
    Closed=False)
t_talpmagasság = Number(list_item_5)
magasság = Number(list_item_2)
szélesség = Number(list_item_3)
profil = Curve(polyline)
magasság_2 = ClusterOutput(magasság)
t_talpmagasság_2 = ClusterOutput(t_talpmagasság)
szélesség_2 = ClusterOutput(szélesség)
profil_2 = ClusterOutput(profil)

# ==== cluster Tween2P
point_a = ClusterInput()
point_b = ClusterInput()
factor = ClusterInput()
point_a_2 = Point(point_a)
point_b_2 = Point(point_b)
factor_2 = Number(factor)
vector_2pt = Vector2Pt(PointA=point_a_2, PointB=point_b_2, Unitize=False)  # -> Vector, Length
multiplication = Multiplication(A=vector_2pt.Vector, B=factor_2)
move = Move(Geometry=point_a_2, Motion=multiplication)  # -> Geometry, Transform
tween = Point(move.Geometry)
tween_2 = ClusterOutput(tween)
