# Grasshopper definition Tapétaszámoló.ghx (Grasshopper 1.0.7)
# plug-ins: Heteroptera, G E N E R A T I O N, treesloth01, Pufferfish, LunchBox, Grasshopper-ARCHICAD Live Connection built for Rhinoceros 6, Wombat

integer = Integer(0)
integer_2 = Integer(0)

true_számol_false_nem_számol = BooleanToggle(False)
reset = Button()
wall = Wall([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])
timer = Timer(TimerInterval=5000, Target=tapbuffer)

insert_items = InsertItems(List=wall, Indices=0, Wrap=False)
invert_boolean = InvertBoolean(Boolean=true_számol_false_nem_számol)  # -> Inverted, Number
list_length = ListLength(List=flatten(insert_items))
deconstruct_wall = DeconstructWall(
    Wall=insert_items,
    SurfaceType0_SurfaceType=(1, 0, 0),
    SurfaceType1_ParamName="Reference Side Surfaces",
    SurfaceType1_SurfaceType=(1, 0, 0),
    SurfaceType2_SurfaceType=(1, 0, 0),
    SurfaceType3_SurfaceType=(1, 0, 0),
    SurfaceType4_SurfaceType=(1, 0, 0),
    SurfaceType5_SurfaceType=(1, 0, 0),
    SurfaceType6_SurfaceType=(1, 0, 0),
    SurfaceType7_SurfaceType=(1, 0, 0),
    SurfaceType8_ParamName="Wall Opening Reference Side Surfaces",
    SurfaceType8_SurfaceType=(1, 0, 0),
    SurfaceType9_ParamName="Wall Opening Reference Opposite Side Surfaces",
    SurfaceType9_SurfaceType=(1, 0, 0),
    SurfaceType10_ParamName="Wall Opening Side Surfaces",
    SurfaceType10_SurfaceType=(1, 0, 0),
    SurfaceType11_ParamName="Wall Opening Replacement Surfaces",
    SurfaceType11_SurfaceType=(1, 0, 0))  # -> Curve, Brep, WallSettings, flatten(ReferenceSideSurfaces), WallOpeningReferenceSideSurfaces, WallOpeningReferenceOppositeSideSurfaces, WallOpeningSideSurfaces, WallOpeningReplacementSurfaces
subtraction = Subtraction(A=list_length, B=2)
insert_items_2 = InsertItems(List=wall, Indices=0, Wrap=False)
list_item = ListItem(List=insert_items_2, Index=Slider(4, range=0..10), Wrap=True)
tapbuffer = TapBuffer(Reset=invert_boolean.Inverted, Incremental=Toggle(True), Valve=0, CounterOff=subtraction, Hold=Toggle(True))
extract_wall_settings = ExtractWallSettings(WallSettings=deconstruct_wall.WallSettings)  # -> Structure, BuildingMaterial, Composite, Profile, Height, Thickness, ThicknessTrapezoid, degrees(OutsideSlantAngle)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
ghpython_script = GhPythonScript(x=tapbuffer)  # -> a
# ---------- ghpython_script: Python ----------
__author__ = "krisztian.urr"
__version__ = "2021.05.26"



def my_func():
    Result = 0
    if x >= 0:
        Result = x
    
    
    
    return (Result)

a = my_func()

#suprise madafaka
# ---------- end ghpython_script ----------
event_gate = EventGate(Data=ghpython_script)  # -> Data, IsNew
insert_items_3 = InsertItems(List=deconstruct_wall.ReferenceSideSurfaces, Indices=0, Wrap=False)
merge = Merge(Data1=deconstruct_wall.WallOpeningReferenceSideSurfaces, Data2=deconstruct_wall.WallOpeningSideSurfaces)
wall_height = ListItem(List=extract_wall_settings.Height, Index=event_gate.Data, Wrap=False)
wall_settings = ListItem(List=deconstruct_wall.WallSettings, Index=event_gate.Data, Wrap=False)
reference_side_surface = ListItem(List=insert_items_3, Index=event_gate.Data, Wrap=False)
reference_curve = ListItem(List=deconstruct_wall.Curve, Index=event_gate.Data, Wrap=False)
deconstruct_box = DeconstructBox(Box=reference_side_surface)  # -> Plane, X, Y, Z
end_points = EndPoints(Curve=reference_curve)  # -> Start, End
number = Number(wall_height)
renumber_paths = RenumberPaths(Data=merge)
number_2 = Number(deconstruct_box.Z)
construct_path = ConstructPath(Indices=event_gate.Data)
tree_branch = TreeBranch(Tree=renumber_paths, Path=construct_path, MaintainPaths=True)
insert_items_4 = InsertItems(List=flatten(deconstruct_wall.Brep), Indices=0, Wrap=False)
unit_z = UnitZ(Factor=number_2)
deconstruct_brep = DeconstructBrep(Brep=tree_branch)  # -> flatten(Faces), Edges, Vertices
list_item_2 = ListItem(List=flatten(insert_items_4), Index=event_gate.Data, Wrap=False)
extrude = Extrude(Base=reference_curve, Direction=unit_z)
brep_join = BrepJoin(Breps=deconstruct_brep.Faces)  # -> Breps, Closed
brep_faces_by_direction = BrepFacesByDirection(Brep=list_item_2, Tolerance=0.9)  # -> Top, Bottom, Sides
bounding_box = BoundingBox(Content=brep_join.Breps, Plane=PlaneXY(0, 0, 0), UnionBox=False)  # -> Box, Box_2
collision_one_many = CollisionOneMany(Collider=bounding_box.Box, Obstacles=brep_faces_by_direction.Top)  # -> Collision, Index
list_length_2 = ListLength(List=bounding_box.Box)
equality = Equality(FirstNumber=list_length_2, SecondNumber=0)  # -> Equality, Inequality
dispatch = Dispatch(List=brep_faces_by_direction.Top, DispatchPattern=collision_one_many.Collision)  # -> ListA, ListB
trim_solid = TrimSolid(Shape=extrude, Cutters=bounding_box.Box)
stream_filter = StreamFilter(Gate=equality.Equality, Stream0=dispatch.ListB, Stream1=brep_faces_by_direction.Top)
brep_join_2 = BrepJoin(Breps=stream_filter)  # -> Breps, Closed
split_brep = SplitBrep(Brep=trim_solid, Cutter=brep_join_2.Breps)  # -> flatten(Result)
collision_one_many_2 = CollisionOneMany(Collider=split_brep, Obstacles=reference_curve)  # -> Collision, Index
dispatch_2 = Dispatch(List=split_brep, DispatchPattern=collision_one_many_2.Collision)  # -> ListA, ListB
geometry = Geometry(dispatch_2.ListA)
move_to_point = MoveToPoint(Geometry=[reference_curve, geometry], PointA=end_points.Start, PointB=Point(0, 0, 0))  # -> flatten(Moved), Vector, Transform
list_item_3 = ListItem(List=move_to_point.Moved, Index=0, Wrap=True)  # -> Item, Item1
text = Text(list_item_3.Item)
match_text = MatchText(Text=text, Pattern="Arc-like curve", Case=False)
invert_boolean_2 = InvertBoolean(Boolean=match_text)  # -> Inverted, Number
stream_freeze_gate = StreamFreezeGate(Data=list_item_3.Item, PassingSwitch=invert_boolean_2.Inverted, Freeze=False)
stream_freeze_gate_2 = StreamFreezeGate(Data=list_item_3.Item1, PassingSwitch=match_text, Freeze=False)
xz_plane = XZPlane(Origin=Point(0, 0, 0))
unroll_polysurface = UnrollPolysurface(Polysurface=stream_freeze_gate_2, Plane=xz_plane)  # -> Unrolled, UnrolledPoints, UnrolledCurves
unit_z_2 = UnitZ(Factor=number)
rotate_3d = Rotate3D(Geometry=unroll_polysurface.Unrolled, Angle=degrees(270), Center=Point(0, 0, 0), Axis=Vector(0, -12112.92468, 0))  # -> Geometry, Transform
move = Move(Geometry=rotate_3d.Geometry, Motion=unit_z_2)  # -> Geometry, Transform

oil_can = OilCan(DataList=[0, 1, 2, 3, 4], Reset=reset, Drop=True, DropMode=3)
timer_2 = Timer(TimerInterval=1000, Target=oil_can)
equality_2 = Equality(FirstNumber=oil_can, SecondNumber=4)  # -> Equality, Inequality
stream_filter_2 = StreamFilter(
    Gate=equality_2.Equality,
    Stream0=ColourSwatch(SwatchColor=RGB(255, 0, 0)),
    Stream1=ColourSwatch(SwatchColor=RGB(0, 255, 0)))
create_material = CreateMaterial(Diffuse=stream_filter_2, Specular=stream_filter_2, Emission=stream_filter_2, Transparency=0, Shine=0)
geometry_2 = Geometry(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)
custom_preview = CustomPreview(Geometry=geometry_2, Material=create_material)

unit_x = UnitX(Factor=1)
xy_plane = XYPlane(Origin=Point(0, 0, 0))
end_points_2 = EndPoints(Curve=stream_freeze_gate)  # -> Start, End
deconstruct = Deconstruct(Point=end_points_2.End)  # -> XComponent, YComponent, ZComponent
angle = Angle(VectorA=stream_freeze_gate, VectorB=unit_x, Plane=xy_plane)  # -> Angle, Reflex
smaller_than = SmallerThan(FirstNumber=deconstruct.YComponent, SecondNumber=0)  # -> SmallerThan, OrEqualTo
degrees = Degrees(Radians=angle.Angle)
larger_than = LargerThan(FirstNumber=deconstruct.XComponent, SecondNumber=0)  # -> LargerThan, OrEqualTo
gate_and = GateAnd(A=larger_than.LargerThan, B=smaller_than.SmallerThan)
addition = Addition(A=degrees, B=180)
weave = Weave(Pattern=gate_and, Stream0=degrees, Stream1=addition, NullGaps=False)
larger_than_2 = LargerThan(FirstNumber=weave, SecondNumber=90)  # -> LargerThan, OrEqualTo
subtraction_2 = Subtraction(A=360, B=weave)
weave_2 = Weave(Pattern=larger_than_2.OrEqualTo, Stream0=weave, Stream1=subtraction_2, NullGaps=False)
radians = Radians(Degrees=weave_2)
negative = Negative(Value=radians)
addition_2 = Addition(A=weave, B=180)
radians_2 = Radians(Degrees=addition_2)
weave_3 = Weave(Pattern=gate_and, Stream0=negative, Stream1=radians_2, NullGaps=False)
rotate_3d_2 = Rotate3D(Geometry=list_item_3.Item1, Angle=weave_3, Center=Point(0, 0, 0), Axis=Vector(0, 0, 1))  # -> Geometry, Transform
ghpython_script_2 = GhPythonScript(x=rotate_3d_2.Geometry)  # -> a
# ---------- ghpython_script_2: Python ----------
__author__ = "krisztian.urr"
__version__ = "2021.05.26"




def my_func():
    Result = x
    if x == None:
        Result = 0
    
    return ( Result )

a = my_func()
# ---------- end ghpython_script_2 ----------

data = Data(wall_settings)
extract_wall_settings_2 = ExtractWallSettings(WallSettings=data)  # -> Structure, BuildingMaterial, Composite, Profile, Height, Thickness, ThicknessTrapezoid, degrees(OutsideSlantAngle)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
extract_property_settings = ExtractPropertySettings(PropertySettings=extract_wall_settings_2.PropertySettings)  # -> ElementClassification, Properties
text_split = TextSplit(Text=extract_property_settings.Properties)  # -> flatten(Result)
cull_pattern = CullPattern(List=text_split, CullPattern=[True, False])
be_tapéta = Text("BE-TAPÉTA")
find_similar_member = FindSimilarMember(Data=be_tapéta, Set=cull_pattern)  # -> Hit, Index
addition_3 = Addition(A=find_similar_member.Index, B=1)
split_list = SplitList(List=cull_pattern, Index=addition_3)  # -> ListA, ListB
list_item_4 = ListItem(List=split_list.ListB, Index=3, Wrap=True)
text_2 = Text(" ")
expression = Expression(x=split_list.ListB, y=text_2, Expression="StartsWith(x,y)")
text_split_2 = TextSplit(Text=list_item_4, Separators=":")
false = Text("FALSE")
cull_pattern_2 = CullPattern(List=text_split_2, CullPattern=[False, True])
find_similar_member_2 = FindSimilarMember(Data=false, Set=expression)  # -> Hit, Index
store = Store(Things=cull_pattern_2, Break=False, Empty=reset)
split_list_2 = SplitList(List=split_list.ListB, Index=find_similar_member_2.Index)  # -> ListA, ListB
text_split_3 = TextSplit(Text=split_list_2.ListA, Separators=":")  # -> flatten(Result)
illesztés_type_option_set = Text("Illesztés (Type = Option Set)")
find_similar_member_3 = FindSimilarMember(Data=illesztés_type_option_set, Set=text_split_3)  # -> Hit, Index
addition_4 = Addition(A=find_similar_member_3.Index, B=1)
list_item_5 = ListItem(List=text_split_3, Index=addition_4, Wrap=True)
text_3 = Text(list_item_5)

weave_4 = Weave(Pattern=match_text, Stream0=ghpython_script_2, Stream1=move.Geometry, NullGaps=False)
geometry_3 = Geometry(weave_4)

egyenes_illesztés = Text("Egyenes illesztés")
eltolt_illesztés = Text("Eltolt illesztés")
illesztés_nélküli = Text("Illesztés nélküli")
expression_2 = Expression(
    x=text_3,
    y=illesztés_nélküli,
    z=egyenes_illesztés,
    w=eltolt_illesztés,
    Expression="if(contains(x,y),0,(if(contains(x,z),1,(if(contains(x,w),2,\"az illesztéstípus nem definiált\")))))")

length = Length(Curve=reference_curve)
stream_gate = StreamGate(Stream=geometry_3, Gate=expression_2)  # -> Target0, Target1, Target2
stream_gate_2 = StreamGate(Stream=text_split_3, Gate=expression_2)  # -> Target0, Target1, Target2
stream_gate_3 = StreamGate(Stream=length, Gate=expression_2)  # -> Target0, Target1, Target2
plane = Plane(PlaneXZ(0, 0, 0))

integer_3 = Integer(2)
integer_4 = Integer(0)
stream_filter_3 = StreamFilter(Gate=reset, Stream0=integer_3, Stream1=integer_4)
stream_filter_4 = StreamFilter(Gate=reset, Stream1=Toggle(True))

tekercs_szélesség_cm_type_option_set = Text("Tekercs szélesség [cm] (Type = Option Set)")
tekercs_hossz_m_type_option_set = Text("Tekercs hossz [m] (Type = Option Set)")
find_similar_member_4 = FindSimilarMember(Data=tekercs_hossz_m_type_option_set, Set=stream_gate_2.Target0)  # -> Hit, Index
find_similar_member_5 = FindSimilarMember(Data=tekercs_szélesség_cm_type_option_set, Set=stream_gate_2.Target0)  # -> Hit, Index
bounding_box_2 = BoundingBox(Content=stream_gate.Target0, Plane=plane)  # -> Box, Box_2
addition_5 = Addition(A=find_similar_member_4.Index, B=1)
addition_6 = Addition(A=find_similar_member_5.Index, B=1)
list_item_6 = ListItem(List=stream_gate_2.Target0, Index=addition_5, Wrap=True)
list_item_7 = ListItem(List=stream_gate_2.Target0, Index=addition_6, Wrap=True)
ghpython_script_3 = GhPythonScript(x=list_item_7)  # -> a
# ---------- ghpython_script_3: Python ----------
__author__ = "krisztian.urr"
__version__ = "2021.05.26"




def my_func():
    Result = 0
    if x > 0:
        Result = x
    
    
    return (Result)

a = my_func()
# ---------- end ghpython_script_3 ----------
ghpython_script_4 = GhPythonScript(x=list_item_6)  # -> a; same code as ghpython_script_3
multiplication = Multiplication(A=ghpython_script_3, B=10)
multiplication_2 = Multiplication(A=ghpython_script_4, B=1000)
plane_surface = PlaneSurface(Plane=plane, XSize=multiplication_2, YSize=multiplication)
deconstruct_plane = DeconstructPlane(Plane=plane_surface)  # -> Origin, XAxis, YAxis, ZAxis
move_to_point_2 = MoveToPoint(Geometry=plane_surface, PointA=deconstruct_plane.Origin, PointB=Point(0, 0, 0))  # -> Moved, Vector, Transform
division = Division(A=stream_gate_3.Target0, B=multiplication)
rotate_direction = RotateDirection(Geometry=move_to_point_2.Moved, Center=Point(0, 0, 0), From=Vector(7159.494132, 0, 0), To=Vector(0, 0, 5023.921013))  # -> Geometry, Transform
unit_x_2 = UnitX(Factor=multiplication)
round = Round(Number=division)  # -> Nearest, Floor, Ceiling
linear_array = LinearArray(Geometry=rotate_direction.Geometry, Direction=unit_x_2, Count=round.Ceiling)  # -> Geometry, Transform
deconstruct_brep_2 = DeconstructBrep(Brep=linear_array.Geometry)  # -> Faces, simplify(Edges), Vertices
join_curves = JoinCurves(Curves=deconstruct_brep_2.Edges, Preserve=False)  # -> flatten(Curves)
split_brep_multiple = SplitBrepMultiple(Brep=stream_gate.Target0, Cutters=join_curves)  # -> flatten(Result)
bounding_box_3 = BoundingBox(Content=split_brep_multiple, Plane=PlaneXY(0, 0, 0))  # -> Box, Box_2
deconstruct_box_2 = DeconstructBox(Box=bounding_box_3.Box)  # -> Plane, X, Y, Z
integer_5 = Integer(deconstruct_box_2.Z)
mass_addition = MassAddition(Input=integer_5)  # -> Result, PartialResults
ghpython_script_5 = GhPythonScript(x=mass_addition.PartialResults, y=multiplication_2, z=10000)  # -> a, b; inputs x: list
# ---------- ghpython_script_5: Python ----------
__author__ = "krisztian.urr"
__version__ = "2021.09.27"

import rhinoscriptsyntax as rs

List = x
wpLength = y

corrValue = 0
checkIdx = 0

for value in List:
    corrValue = value-checkIdx*wpLength
    if corrValue > wpLength:
        checkIdx += 1

a = checkIdx+1
b = ((checkIdx+1)*wpLength)-List[-1]
# ---------- end ghpython_script_5 ----------
timeshifter = TimeShifter(Data=ghpython_script_5.b, Capacity=stream_filter_3)
integer_6 = Integer(0)
stream_filter_5 = StreamFilter(Gate=reset, Stream0=timeshifter, Stream1=integer_6)
stream_freeze_gate_3 = StreamFreezeGate(Data=stream_filter_5, PassingSwitch=True, Freeze=True, Hold=True)  # -> flatten(Data)
smaller_than_2 = SmallerThan(FirstNumber=mass_addition.PartialResults, SecondNumber=stream_freeze_gate_3)  # -> SmallerThan, OrEqualTo
ghpython_script_6 = GhPythonScript(x=smaller_than_2.OrEqualTo)  # -> a
# ---------- ghpython_script_6: Python ----------
__author__ = "krisztian.urr"
__version__ = "2021.05.26"




def my_func():
    Result = 0
    if x == True:
        Result = x
    
    
    return (Result)

a = my_func()
# ---------- end ghpython_script_6 ----------
dispatch_unweave = DispatchUnweave(Data=mass_addition.PartialResults, Pattern=ghpython_script_6)  # -> flatten(Out00), Out01, Out02
ghpython_script_7 = GhPythonScript(x=dispatch_unweave.Out00, y=multiplication_2)  # -> flatten(a); inputs x: list
# ---------- ghpython_script_7: Python ----------
__author__ = "krisztian.urr"
__version__ = "2021.09.27"

import rhinoscriptsyntax as rs
from scriptcontext import sticky
from Grasshopper import DataTree


List = x
wpLength = y
corrValue = 0
checkIdx = 0

if len(List) == 0:
    List = [0]

def my_func(checkIdx):
    Result = 0
    if len(List) == 1 and List[0] == 0:
        Result = 0
    else:
        for value in List:
            corrValue = value-checkIdx*wpLength
            if corrValue > wpLength:
                checkIdx += 1
            if checkIdx >= 0:
                Result = checkIdx+1
            if type(corrValue) == None:
                Result = 0

    return Result


a = my_func(checkIdx)
# ---------- end ghpython_script_7 ----------
data_dam = DataDam(DataDataA=ghpython_script_7, BufferDelay=5000000, BufferMode=2)
equality_3 = Equality(FirstNumber=data_dam, SecondNumber=0)  # -> Equality, Inequality
sift_pattern = SiftPattern(List=data_dam, SiftPattern=equality_3.Equality)  # -> Output0, Output1
null_item = NullItem(Item=sift_pattern.Output0)  # -> NullFlags, InvalidFlags, Description
gate_not = GateNot(A=null_item.NullFlags)
cull_pattern_3 = CullPattern(List=sift_pattern.Output0, CullPattern=gate_not)  # -> flatten(List)

number_3 = Number(0)
graft_tree = GraftTree(Tree=store, IncludeEmptyLists=True, IncludeNullItems=True)  # -> flatten(Tree)
create_set = CreateSet(List=graft_tree)  # -> graft(Set), Map
renumber_paths_2 = RenumberPaths(Data=create_set.Set)
text_4 = Text("  tekercs tapéta szükséges.")
addition_7 = Addition(A=event_gate.Data, B=1)
equality_4 = Equality(FirstNumber=list_length, SecondNumber=addition_7)  # -> Equality, Inequality
text_5 = Text("Szükséges tapéta mennyiségek.")

tekercs_szélesség_cm_type_option_set_2 = Text("Tekercs szélesség [cm] (Type = Option Set)")
tekercs_hossz_m_type_option_set_2 = Text("Tekercs hossz [m] (Type = Option Set)")
eltolás_mértéke_type_option_set = Text("Eltolás mértéke (Type = Option Set)")
rapport_cm_type_option_set = Text("Rapport [cm] (Type = Option Set)")
find_similar_member_6 = FindSimilarMember(Data=eltolás_mértéke_type_option_set, Set=stream_gate_2.Target2)  # -> Hit, Index
bounding_box_4 = BoundingBox(Content=stream_gate.Target2, Plane=plane)  # -> Box, Box_2
find_similar_member_7 = FindSimilarMember(Data=tekercs_hossz_m_type_option_set_2, Set=stream_gate_2.Target2)  # -> Hit, Index
find_similar_member_8 = FindSimilarMember(Data=rapport_cm_type_option_set, Set=stream_gate_2.Target2)  # -> Hit, Index
find_similar_member_9 = FindSimilarMember(Data=tekercs_szélesség_cm_type_option_set_2, Set=stream_gate_2.Target2)  # -> Hit, Index
addition_8 = Addition(A=find_similar_member_6.Index, B=1)
addition_9 = Addition(A=find_similar_member_9.Index, B=1)
addition_10 = Addition(A=find_similar_member_7.Index, B=1)
addition_11 = Addition(A=find_similar_member_8.Index, B=1)
list_item_8 = ListItem(List=stream_gate_2.Target2, Index=addition_8, Wrap=True)
list_item_9 = ListItem(List=stream_gate_2.Target2, Index=addition_10, Wrap=True)
list_item_10 = ListItem(List=stream_gate_2.Target2, Index=addition_9, Wrap=True)
list_item_11 = ListItem(List=stream_gate_2.Target2, Index=addition_11, Wrap=True)
ghpython_script_8 = GhPythonScript(x=list_item_8)  # -> a; same code as ghpython_script_3
ghpython_script_9 = GhPythonScript(x=list_item_10)  # -> a; same code as ghpython_script_3
ghpython_script_10 = GhPythonScript(x=list_item_9)  # -> a; same code as ghpython_script_3
ghpython_script_11 = GhPythonScript(x=list_item_11)  # -> a; same code as ghpython_script_3
multiplication_3 = Multiplication(A=ghpython_script_9, B=10)
complex_components = ComplexComponents(Complex=ghpython_script_8)  # -> Real, Imaginary
multiplication_4 = Multiplication(A=ghpython_script_11, B=10)
multiplication_5 = Multiplication(A=ghpython_script_10, B=1000)
division_2 = Division(A=multiplication_5, B=multiplication_4)
multiplication_6 = Multiplication(A=multiplication_4, B=complex_components.Real)
round_2 = Round(Number=division_2)  # -> Nearest, Floor, Ceiling
division_3 = Division(A=stream_gate_3.Target2, B=multiplication_3)
round_3 = Round(Number=division_3)  # -> Nearest, Floor, Ceiling
rectangular = Rectangular(Plane=plane, SizeX=multiplication_3, SizeY=multiplication_4, ExtentX=round_3.Ceiling, ExtentY=round_2.Floor)  # -> Cells, Points
brep_edges = BrepEdges(Brep=rectangular.Cells)  # -> Naked, Interior, NonManifold
join_curves_2 = JoinCurves(Curves=brep_edges.Naked, Preserve=False)  # -> simplify(Curves)
path_mapper = PathMapper(join_curves_2, source="{A;B}", target="{0}(A)")
list_length_3 = ListLength(List=path_mapper)
addition_12 = Addition(A=list_length_3, B=1)
series = Series(Start=0, Step=1, Count=addition_12)
második_index = GhPythonScript(x=series)  # -> out, a; inputs x: list
# ---------- második_index: Python ----------
__author__ = "krisztian.urr"
__version__ = "2021.04.12"

import rhinoscriptsyntax as rs

inputList = x
listLength = len(inputList)
lastIndex = len(inputList)-1
modIndex = 1
checkIndex = 0
outList = []

while modIndex < listLength:
    modNumber = 0
    modNumber = inputList[modIndex]
    outList.append(modNumber-1)
    modIndex = modIndex + 2
a = outList
# ---------- end második_index ----------
második_index_2 = GhPythonScript(x=series)  # -> out, a; inputs x: list
# ---------- második_index_2: Python ----------
__author__ = "krisztian.urr"
__version__ = "2021.04.12"

import rhinoscriptsyntax as rs

inputList = x
listLength = len(inputList)
lastIndex = len(inputList)-1
modIndex = 1
checkIndex = 0
outList = []

while modIndex < listLength:
    modNumber = 0
    modNumber = inputList[modIndex]+1
    outList.append(modNumber-1)
    modIndex = modIndex + 2
a = outList
# ---------- end második_index_2 ----------
text_6 = Text("{")
text_7 = Text("}")
concatenate = Concatenate(Fragment_A=text_6, A=második_index_2.a, Fragment_B=text_7)  # -> flatten(Result)
concatenate_2 = Concatenate(Fragment_A=text_6, A=második_index.a, Fragment_B=text_7)  # -> flatten(Result)
path_mapper_2 = PathMapper(join_curves_2, source="{A;B}", target="{A}")
path_mapper_3 = PathMapper(join_curves_2, source="{A;B}", target="{A}")
split_tree = SplitTree(Data=path_mapper_3, Masks=flatten(concatenate))  # -> Positive, Negative
unit_z_3 = UnitZ(Factor=multiplication_6)
split_tree_2 = SplitTree(Data=path_mapper_2, Masks=flatten(concatenate_2))  # -> Positive, Negative
join_curves_3 = JoinCurves(Curves=split_tree.Positive, Preserve=False)
negative_2 = Negative(Value=unit_z_3)
move_2 = Move(Geometry=join_curves_3, Motion=negative_2)  # -> Geometry, Transform
brep_brep = BrepBrep(BrepA=[move_2.Geometry, split_tree_2.Positive], BrepB=stream_gate.Target2, UseTasks=True)  # -> simplify(Curves), Points
tree_statistics = TreeStatistics(Tree=brep_brep.Curves)  # -> Paths, Length, Count
boolean = Boolean(tree_statistics.Length)
partition_list = PartitionList(List=boolean, Size=round_2.Floor)  # -> simplify(Chunks)
number_4 = Number(partition_list)
mass_addition_2 = MassAddition(Input=number_4)  # -> flatten(Result), PartialResults
mass_addition_3 = MassAddition(Input=mass_addition_2.Result)  # -> Result, PartialResults
ghpython_script_12 = GhPythonScript(x=mass_addition_3.PartialResults, y=round_2.Floor, z=10000)  # -> a, b; inputs x: list; same code as ghpython_script_5

timeshifter_2 = TimeShifter(Data=ghpython_script_12.b, Capacity=stream_filter_3)
stream_filter_6 = StreamFilter(Gate=reset, Stream0=timeshifter_2, Stream1=integer_2)
stream_freeze_gate_4 = StreamFreezeGate(Data=stream_filter_6, PassingSwitch=True, Freeze=True, Hold=True)  # -> flatten(Data)

smaller_than_3 = SmallerThan(FirstNumber=mass_addition_3.PartialResults, SecondNumber=stream_freeze_gate_4)  # -> SmallerThan, OrEqualTo
ghpython_script_13 = GhPythonScript(x=smaller_than_3.OrEqualTo)  # -> a; same code as ghpython_script_6
dispatch_unweave_2 = DispatchUnweave(Data=mass_addition_3.PartialResults, Pattern=ghpython_script_13)  # -> Out00, Out01, Out02
ghpython_script_14 = GhPythonScript(x=dispatch_unweave_2.Out00, y=round_2.Floor)  # -> flatten(a); inputs x: list; same code as ghpython_script_7
data_dam_2 = DataDam(DataDataA=ghpython_script_14, BufferDelay=5000000, BufferMode=2)
equality_5 = Equality(FirstNumber=data_dam_2, SecondNumber=0)  # -> Equality, Inequality
sift_pattern_2 = SiftPattern(List=data_dam_2, SiftPattern=equality_5.Equality)  # -> Output0, Output1
null_item_2 = NullItem(Item=sift_pattern_2.Output0)  # -> NullFlags, InvalidFlags, Description
gate_not_2 = GateNot(A=null_item_2.NullFlags)
cull_pattern_4 = CullPattern(List=sift_pattern_2.Output0, CullPattern=gate_not_2)  # -> flatten(List)

panel = Panel(mass_addition_3.PartialResults)
panel_3 = Panel(ghpython_script_14)

tekercs_szélesség_cm_type_option_set_3 = Text("Tekercs szélesség [cm] (Type = Option Set)")
tekercs_hossz_m_type_option_set_3 = Text("Tekercs hossz [m] (Type = Option Set)")
rapport_cm_type_option_set_2 = Text("Rapport [cm] (Type = Option Set)")
bounding_box_5 = BoundingBox(Content=stream_gate.Target1, Plane=plane)  # -> Box, Box_2
find_similar_member_10 = FindSimilarMember(Data=tekercs_szélesség_cm_type_option_set_3, Set=stream_gate_2.Target1)  # -> Hit, Index
find_similar_member_11 = FindSimilarMember(Data=tekercs_hossz_m_type_option_set_3, Set=stream_gate_2.Target1)  # -> Hit, Index
find_similar_member_12 = FindSimilarMember(Data=rapport_cm_type_option_set_2, Set=stream_gate_2.Target1)  # -> Hit, Index
addition_13 = Addition(A=find_similar_member_11.Index, B=1)
addition_14 = Addition(A=find_similar_member_10.Index, B=1)
addition_15 = Addition(A=find_similar_member_12.Index, B=1)
list_item_12 = ListItem(List=stream_gate_2.Target1, Index=addition_14, Wrap=True)
list_item_13 = ListItem(List=stream_gate_2.Target1, Index=addition_13, Wrap=True)
list_item_14 = ListItem(List=stream_gate_2.Target1, Index=addition_15, Wrap=True)
ghpython_script_15 = GhPythonScript(x=list_item_12)  # -> a; same code as ghpython_script_3
ghpython_script_16 = GhPythonScript(x=list_item_13)  # -> a; same code as ghpython_script_3
ghpython_script_17 = GhPythonScript(x=list_item_14)  # -> a; same code as ghpython_script_3
multiplication_7 = Multiplication(A=ghpython_script_16, B=1000)
multiplication_8 = Multiplication(A=ghpython_script_15, B=10)
multiplication_9 = Multiplication(A=ghpython_script_17, B=10)
division_4 = Division(A=multiplication_7, B=multiplication_9)
round_4 = Round(Number=division_4)  # -> Nearest, Floor, Ceiling
division_5 = Division(A=stream_gate_3.Target1, B=multiplication_8)
round_5 = Round(Number=division_5)  # -> Nearest, Floor, Ceiling
rectangular_2 = Rectangular(Plane=plane, SizeX=multiplication_8, SizeY=multiplication_9, ExtentX=round_5.Ceiling, ExtentY=round_4.Floor)  # -> Cells, Points
brep_edges_2 = BrepEdges(Brep=rectangular_2.Cells)  # -> Naked, Interior, NonManifold
join_curves_4 = JoinCurves(Curves=brep_edges_2.Naked, Preserve=False)
brep_brep_2 = BrepBrep(BrepA=stream_gate.Target1, BrepB=join_curves_4)  # -> Curves, Points
tree_statistics_2 = TreeStatistics(Tree=brep_brep_2.Curves)  # -> Paths, Length, Count
subtraction_3 = Subtraction(A=round_4.Ceiling, B=1)
boolean_2 = Boolean(tree_statistics_2.Length)
partition_list_2 = PartitionList(List=boolean_2, Size=subtraction_3)  # -> simplify(Chunks)
number_5 = Number(partition_list_2)
mass_addition_4 = MassAddition(Input=number_5)  # -> flatten(Result), PartialResults
mass_addition_5 = MassAddition(Input=mass_addition_4.Result)  # -> Result, PartialResults
ghpython_script_18 = GhPythonScript(x=mass_addition_5.PartialResults, y=subtraction_3, z=10000)  # -> a, b; inputs x: list; same code as ghpython_script_5

timeshifter_3 = TimeShifter(Data=ghpython_script_18.b, Capacity=stream_filter_3)
stream_filter_7 = StreamFilter(Gate=reset, Stream0=timeshifter_3, Stream1=integer)
stream_freeze_gate_5 = StreamFreezeGate(Data=stream_filter_7, PassingSwitch=True, Freeze=True, Hold=True)  # -> flatten(Data)

smaller_than_4 = SmallerThan(FirstNumber=mass_addition_5.PartialResults, SecondNumber=stream_freeze_gate_5)  # -> SmallerThan, OrEqualTo
ghpython_script_19 = GhPythonScript(x=smaller_than_4.OrEqualTo)  # -> a; same code as ghpython_script_6
dispatch_unweave_3 = DispatchUnweave(Data=mass_addition_5.PartialResults, Pattern=ghpython_script_19)  # -> Out00, Out01, Out02
ghpython_script_20 = GhPythonScript(x=dispatch_unweave_3.Out00, y=subtraction_3)  # -> flatten(a); inputs x: list; same code as ghpython_script_7
data_dam_3 = DataDam(DataDataA=ghpython_script_20, BufferDelay=5000000, BufferMode=2)
equality_6 = Equality(FirstNumber=data_dam_3, SecondNumber=0)  # -> Equality, Inequality
sift_pattern_3 = SiftPattern(List=data_dam_3, SiftPattern=equality_6.Equality)  # -> Output0, Output1
null_item_3 = NullItem(Item=sift_pattern_3.Output0)  # -> NullFlags, InvalidFlags, Description
gate_not_3 = GateNot(A=null_item_3.NullFlags)
cull_pattern_5 = CullPattern(List=sift_pattern_3.Output0, CullPattern=gate_not_3)  # -> flatten(List)

entwine = Entwine(Branch00=cull_pattern_3, Branch01=cull_pattern_5, Branch02=cull_pattern_4, FlattenInputs=True)  # -> flatten(Result)
data_dam_4 = DataDam(DataDataA=entwine, BufferDelay=10000000, BufferMode=2)
null_item_4 = NullItem(Item=data_dam_4)  # -> NullFlags, InvalidFlags, Description
gate_not_4 = GateNot(A=null_item_4.NullFlags)
cull_pattern_6 = CullPattern(List=data_dam_4, CullPattern=gate_not_4)
ghpython_script_21 = GhPythonScript(x=cull_pattern_6, enable=true_számol_false_nem_számol, reset=reset, limit=10000000)  # -> x; inputs x: Int32
# ---------- ghpython_script_21: Python ----------
__author__ = "krisztian.urr"
__version__ = "2021.09.27"

import rhinoscriptsyntax as rs
from scriptcontext import sticky
from Grasshopper import DataTree

result = None

if reset or 'x' not in sticky: sticky['x'] = [] 
if enable and not reset: sticky['x'].append(x)
if x == 0 : x == result
x = sticky['x'][-limit:] if limit > 0 else sticky['x']
# ---------- end ghpython_script_21 ----------
sub_list = SubList(List=ghpython_script_21, Domain=Domain(0, 2), Wrap=True)  # -> List, Index
null_item_5 = NullItem(Item=sub_list.List)  # -> NullFlags, InvalidFlags, Description
mass_addition_6 = MassAddition(Input=null_item_5.NullFlags)  # -> Result, PartialResults
mass_addition_7 = MassAddition(Input=null_item_5.NullFlags)  # -> Result, PartialResults
equality_7 = Equality(FirstNumber=mass_addition_6.Result, SecondNumber=3)  # -> Equality, Inequality
stream_filter_8 = StreamFilter(Gate=equality_7.Equality, Stream0=mass_addition_7.Result, Stream1=mass_addition_6.Result)
split_list_3 = SplitList(List=ghpython_script_21, Index=stream_filter_8)  # -> ListA, ListB
replace_nulls = ReplaceNulls(Items=split_list_3.ListB, Replacements=number_3)  # -> Items, Count
index_allocator = IndexAllocator(Index=create_set.Map, Data=replace_nulls.Items, addbranch=False)
mass_addition_8 = MassAddition(Input=index_allocator)  # -> Result, PartialResults
concatenate_3 = Concatenate(FragmentA=mass_addition_8.Result, FragmentB=text_4)
set_union = SetUnion(Set_A=renumber_paths_2, Set_B=concatenate_3)  # -> flatten(Union)
text_8 = Text(set_union)
excel_write_legacy = ExcelWriteLEGACY(
    WriteToggle=equality_4.Equality,
    WriteHeading=False,
    ClearSheet=False,
    Worksheet=1,
    ColumnStart=1,
    RowStart=1,
    ColumnHeadings=text_5,
    Column1=text_8)

panel_4 = Panel(set_union)

deconstruct_box_3 = DeconstructBox(Box=[bounding_box_2.Box, bounding_box_5.Box, bounding_box_4.Box])  # -> Plane, X, Y, Z
list_item_15 = ListItem(List=deconstruct_box_3.Y, Index=0, Wrap=True)  # -> flatten(Item)
number_6 = Number(deconstruct_box_3.X)
list_item_16 = ListItem(List=list_item_15, Index=0, Wrap=True)
mass_addition_9 = MassAddition(Input=number_6)  # -> Result, PartialResults
number_7 = Number(list_item_16)
unit_x_3 = UnitX(Factor=mass_addition_9.Result)
unit_z_4 = UnitZ(Factor=number_7)
point = Point(unit_x_3)
move_3 = Move(Geometry=point, Motion=unit_z_4)  # -> Geometry, Transform
aligned_dimension = AlignedDimension(Plane=plane, PointA=Point(0, 0, 0), PointB=point, Offset=-1000, Text="{0:0.00}", Size=500)
aligned_dimension_2 = AlignedDimension(Plane=plane, PointA=point, PointB=move_3.Geometry, Offset=-1000, Text="{0:0.00}", Size=500)
