# Grasshopper definition Wall_Re-Make tool.ghx (Grasshopper 1.0.7)

value_list = ValueList({"Bounding box": 0, "Simplyfied wall with openings": 1, "Wall Re-make": 2}, selected="Wall Re-make")
wall_reference_curve = Curve()
bounding_box_symplified_wall_with_openin = BoundingBoxSymplifiedWallWithOpeningsWallReMake(gate=value_list, plane=wall_reference_curve, geometry=wall_reference_curve, factor=1, curve=wall_reference_curve)  # "Bounding box / Symplified wall with openings / Wall Re-make"

# ==== cluster BoundingBoxSymplifiedWallWithOpeningsWallReMake
brep = ClusterInput()
merge_faces = MergeFaces(Brep=brep)  # -> Breps, Before, After
deconstruct_brep = DeconstructBrep(Brep=merge_faces.Breps)  # -> Faces, Edges, Vertices
brep_join = BrepJoin(Breps=deconstruct_brep.Faces)  # -> flatten(Breps), Closed
area_moments = AreaMoments(Geometry=brep_join.Breps)  # -> Area, Centroid, Inertia, InertiaError, Secondary, SecondaryError, Gyration
number = Number(area_moments.Gyration)
equality = Equality(FirstNumber=number, SecondNumber=0)  # -> Equality, Inequality
dispatch = Dispatch(List=brep_join.Breps, DispatchPattern=equality.Equality)  # -> ListA, ListB
curve = ClusterInput()
solid_union = SolidUnion(Breps=dispatch.ListB)
curve_middle = CurveMiddle(Curve=curve)
boundary_volume = BoundaryVolume(Boundaries=solid_union)
xy_plane = XYPlane(Origin=curve_middle)
unit_z = UnitZ(Factor=1)
factor = ClusterInput()
unit_z_2 = UnitZ(Factor=factor)
mesh_shadow = MeshShadow(Mesh=boundary_volume, Light=unit_z, Plane=xy_plane)
geometry = ClusterInput()
extrude = Extrude(Base=mesh_shadow, Direction=unit_z_2)
rotate = Rotate(Geometry=geometry, Angle=1.570796327, Plane=xy_plane)  # -> Geometry, Transform
cap_holes = CapHoles(Brep=extrude)
mesh_shadow_2 = MeshShadow(Mesh=boundary_volume, Light=rotate.Geometry, Plane=rotate.Geometry)
simplify_curve = SimplifyCurve(Curve=mesh_shadow_2)  # -> Curve, Simplified
boundary_surfaces = BoundarySurfaces(Edges=simplify_curve.Curve)
extrude_along = ExtrudeAlong(Base=boundary_surfaces, Curve=rotate.Geometry)
plane = ClusterInput()
solid_intersection = SolidIntersection(BrepsA=extrude_along, BrepsB=cap_holes)
bounding_box = BoundingBox(Content=boundary_volume, Plane=plane)  # -> Box, Box_2
gate = ClusterInput()
solid_intersection_2 = SolidIntersection(BrepsA=bounding_box.Box, BrepsB=extrude_along)
stream_filter = StreamFilter(Gate=gate, Stream0=bounding_box.Box, Stream1=solid_intersection_2, Stream2=solid_intersection)
s_2 = ClusterOutput(stream_filter)
