# Grasshopper definition Poroszsüveg generátor.ghx (Grasshopper 1.0.7)
# plug-ins: Grasshopper-ARCHICAD Live Connection built for Rhinoceros 7

value_list = ValueList({"430x100x64", "380x100x54", "300x100x46", "300x90x41", "260x90x35", "260x75x28", "230x90x32", "230x75x26", "200x90x30", "200x75x23", "180x90x26", "180x75x20", "150x90x24", "150x75x18", "125x65x15", "100x50x10"}, selected="200x90x30")
cluster = Cluster(text=value_list)  # -> profil_2, t_talpmagasság_cm_2, szélesség_cm_2
scale = Scale(Geometry=cluster.profil_2, Center=Point(0, 0, 0), Factor=0.1)  # -> Geometry, Transform
panel = Panel("L:\03_szervezeti_egysegek\09_bim\11_Fejlesztesek\Poroszsüveg_generátor\IPECSV.csv")

boltozat_magasság = Slider(154, range=0..500)
tégla_vastagság = Slider(111, range=0..500)
szinkron = BooleanToggle(False)

szélprofil = Geometry(scale.Geometry)

# ---- group: AC profil
profile = Profile()

# ----
file_path = FilePath(panel)

# ---- group: Födém kontúr
_2d_curve = _2DCurve(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)

# ---- group: Gerendák
_2d_curve_2 = _2DCurve([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])

# ----
ipe_beam = IPEBEAM(ipe_profile=profile, file_path=file_path)  # -> profil_2, t_talpmagasság_cm_2
generic_i_beam = GenericIBeam(h_magasság=200, b_szélesség=80, s_vastagság=7, t_talpmagasság=10)  # -> profil_2, t_talpmagasság_cm_2
curve = Curve(_2d_curve)
curve_2 = Curve(_2d_curve_2)
first_last = FirstLast(list=curve_2)  # -> first_value_2, last_value_2

# ---- group: Külső gerendák
curve_3 = Curve([first_last.first_value_2, first_last.last_value_2])

# ----
split_list = SplitList(List=curve_3, Index=1)  # -> ListA, ListB
end_points = EndPoints(Curve=split_list.ListA)  # -> Start, End
end_points_2 = EndPoints(Curve=split_list.ListB)  # -> Start, End
scale_2 = Scale(Geometry=ipe_beam.profil_2, Center=Point(0, 0, 0), Factor=0.1)  # -> Geometry, Transform

# ---- group: DWG profil
curve_4 = Curve(scale_2.Geometry)

# ----
beamsetp = BeamSettingsProfile(
    Profile=profile,
    Layer=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,
    Profile_2=profile,
    Layer_2=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,
    AC_ActiveState_Name="Profile")
curve_closest_point = CurveClosestPoint(Point=end_points.Start, Curve=split_list.ListB)  # -> Point, Parameter, Distance
curve_closest_point_2 = CurveClosestPoint(Point=end_points_2.Start, Curve=split_list.ListA)  # -> Point, Parameter, Distance
number = Number(ipe_beam.t_talpmagasság_cm_2)
split_list_2 = SplitList(List=curve_2, Index=1)  # -> ListA, ListB
vector_2pt = Vector2Pt(PointA=end_points.Start, PointB=curve_closest_point.Point, Unitize=False)  # -> Vector, Length
vector_2pt_2 = Vector2Pt(PointA=end_points_2.Start, PointB=curve_closest_point_2.Point, Unitize=False)  # -> Vector, Length
vector_2pt_3 = Vector2Pt(PointA=end_points.Start, PointB=end_points.End, Unitize=False)  # -> Vector, Length
vector_2pt_4 = Vector2Pt(PointA=end_points_2.Start, PointB=end_points_2.End, Unitize=False)  # -> Vector, Length
list_length = ListLength(List=split_list_2.ListB)
split_list_3 = SplitList(List=reverse(split_list_2.ListB), Index=1)  # -> ListA, ListB
subtraction = Subtraction(A=list_length, B=1)
construct_plane = ConstructPlane(Origin=end_points.Start, XAxis=vector_2pt.Vector, YAxis=vector_2pt_3.Vector)
construct_plane_2 = ConstructPlane(Origin=end_points_2.Start, XAxis=vector_2pt_2.Vector, YAxis=vector_2pt_4.Vector)

# ---- group: Belső gerendák
curve_5 = Curve(split_list_3.ListB)

# ----
beam = Beam(Synchronize=szinkron, Curve=curve_5, BeamSettings=beamsetp)
flip_plane = FlipPlane(Plane=construct_plane_2, ReverseX=False, ReverseY=True, SwapAxes=False)
end_points_3 = EndPoints(Curve=split_list_3.ListB)  # -> Start, End
xy_plane = XYPlane(Origin=Point(0, 0, 0))
orient = Orient(Geometry=szélprofil, Source=xy_plane, Target=construct_plane)  # -> Geometry, Transform
orient_2 = Orient(Geometry=szélprofil, Source=xy_plane, Target=flip_plane)  # -> Geometry, Transform
sort_points = SortPoints(Points=end_points_3.Start)  # -> Points, Indices
sort_points_2 = SortPoints(Points=end_points_3.End)  # -> Points, Indices
extrude = Extrude(Base=orient.Geometry, Direction=vector_2pt_3.Vector)
extrude_2 = Extrude(Base=orient_2.Geometry, Direction=vector_2pt_4.Vector)
ghpython_script = GhPythonScript(x=sort_points_2.Points)  # -> a; inputs x: list
# ---------- ghpython_script: Python ----------
__author__ = "jozsef.szilagyi"
__version__ = "2021.06.02"

import rhinoscriptsyntax as rs

L_Points = x
I_ListLength = len(L_Points)
OutList = []
checkPoint = 0

while checkPoint < I_ListLength-1:
    Point1 = L_Points[checkPoint]
    Point2 = L_Points[checkPoint+1]
    OutList.append(Point1)
    OutList.append(Point2)
    checkPoint = checkPoint+1

a = OutList
# ---------- end ghpython_script ----------
ghpython_script_2 = GhPythonScript(x=sort_points.Points)  # -> a; inputs x: list; same code as ghpython_script
partition_list = PartitionList(List=ghpython_script_2, Size=2)
partition_list_2 = PartitionList(List=ghpython_script, Size=2)
cap_holes = CapHoles(Brep=extrude)
cap_holes_2 = CapHoles(Brep=extrude_2)
deconstruct_beam = DeconstructBeam(
    Beam=beam,
    SurfaceType0_SurfaceType=(1, 0, 0),
    SurfaceType1_SurfaceType=(1, 0, 0),
    SurfaceType2_SurfaceType=(1, 0, 0),
    SurfaceType3_SurfaceType=(1, 0, 0),
    SurfaceType4_SurfaceType=(1, 0, 0),
    SurfaceType5_SurfaceType=(1, 0, 0),
    SurfaceType6_SurfaceType=(1, 0, 0),
    SurfaceType7_SurfaceType=(1, 0, 0),
    SurfaceType8_SurfaceType=(1, 0, 0),
    SurfaceType9_SurfaceType=(1, 0, 0))  # -> Curve, Brep, BeamSettings
list_item = ListItem(List=partition_list, Index=0, Wrap=True)  # -> Item, Item1
list_item_2 = ListItem(List=partition_list_2, Index=0, Wrap=True)  # -> Item, Item1
unit_z = UnitZ(Factor=boltozat_magasság)
tween_2p = Tween2P(point_a=list_item.Item, point_b=list_item.Item1, factor=0.5)
unit_z_2 = UnitZ(Factor=boltozat_magasság)
first_last_2 = FirstLast(list=curve_5)  # -> first_value_2, last_value_2
tween_2p_2 = Tween2P(point_a=list_item_2.Item, point_b=list_item_2.Item1, factor=0.5)
curve_6 = Curve(split_list.ListB)
curve_7 = Curve(first_last_2.first_value_2)
curve_8 = Curve(split_list.ListA)
curve_9 = Curve(first_last_2.last_value_2)
move = Move(Geometry=tween_2p, Motion=unit_z)  # -> Geometry, Transform
move_2 = Move(Geometry=tween_2p_2, Motion=unit_z_2)  # -> Geometry, Transform
end_points_4 = EndPoints(Curve=curve_6)  # -> Start, End
end_points_5 = EndPoints(Curve=curve_7)  # -> Start, End
end_points_6 = EndPoints(Curve=curve_8)  # -> Start, End
end_points_7 = EndPoints(Curve=curve_9)  # -> Start, End
extract_beam_settings = ExtractBeamSettings(BeamSettings=deconstruct_beam.BeamSettings)  # -> Structure, BuildingMaterial, Profile, Height, Width, AxisOffset, degrees(ProfileRotation), Layer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
arc_3pt = Arc3Pt(PointA=list_item.Item, PointB=move.Geometry, PointC=list_item.Item1)  # -> Arc, Plane, Radius
tween_2p_3 = Tween2P(point_a=end_points_4.Start, point_b=end_points_5.Start, factor=0.5)
tween_2p_4 = Tween2P(point_a=end_points_6.Start, point_b=end_points_7.Start, factor=0.5)
tween_2p_5 = Tween2P(point_a=end_points_4.End, point_b=end_points_5.End, factor=0.5)
tween_2p_6 = Tween2P(point_a=end_points_6.End, point_b=end_points_7.End, factor=0.5)
arc_3pt_2 = Arc3Pt(PointA=list_item_2.Item, PointB=move_2.Geometry, PointC=list_item_2.Item1)  # -> Arc, Plane, Radius
number_2 = Number(flatten(extract_beam_settings.Width))
move_3 = Move(Geometry=tween_2p_3, Motion=unit_z_2)  # -> Geometry, Transform
move_4 = Move(Geometry=tween_2p_4, Motion=unit_z_2)  # -> Geometry, Transform
move_5 = Move(Geometry=tween_2p_5, Motion=unit_z_2)  # -> Geometry, Transform
move_6 = Move(Geometry=tween_2p_6, Motion=unit_z_2)  # -> Geometry, Transform
create_set = CreateSet(List=number_2)  # -> Set, Map
arc_3pt_3 = Arc3Pt(PointA=end_points_4.Start, PointB=move_3.Geometry, PointC=end_points_5.Start)  # -> Arc, Plane, Radius
arc_3pt_4 = Arc3Pt(PointA=end_points_6.Start, PointB=move_4.Geometry, PointC=end_points_7.Start)  # -> Arc, Plane, Radius
arc_3pt_5 = Arc3Pt(PointA=end_points_4.End, PointB=move_5.Geometry, PointC=end_points_5.End)  # -> Arc, Plane, Radius
arc_3pt_6 = Arc3Pt(PointA=end_points_6.End, PointB=move_6.Geometry, PointC=end_points_7.End)  # -> Arc, Plane, Radius
vector_2pt_5 = Vector2Pt(PointA=list_item.Item, PointB=list_item.Item1, Unitize=True)  # -> Vector, Length
division = Division(A=create_set.Set, B=2)
division_2 = Division(A=create_set.Set, B=2)
vector_2pt_6 = Vector2Pt(PointA=list_item_2.Item, PointB=list_item_2.Item1, Unitize=True)  # -> Vector, Length
multiplication = Multiplication(A=vector_2pt_5.Vector, B=division)
multiplication_2 = Multiplication(A=vector_2pt_6.Vector, B=division_2)
multiplication_3 = Multiplication(A=boltozat_magasság, B=10)
move_7 = Move(Geometry=list_item.Item, Motion=multiplication)  # -> simplify(Geometry), Transform
move_8 = Move(Geometry=list_item_2.Item, Motion=multiplication_2)  # -> simplify(Geometry), Transform
unit_z_3 = UnitZ(Factor=tégla_vastagság)
unit_z_4 = UnitZ(Factor=multiplication_3)
move_9 = Move(Geometry=move_8.Geometry, Motion=unit_z_4)  # -> simplify(Geometry), Transform
move_10 = Move(Geometry=move_7.Geometry, Motion=unit_z_4)  # -> simplify(Geometry), Transform
line = Line(StartPoint=move_8.Geometry, EndPoint=move_9.Geometry)
line_2 = Line(StartPoint=move_7.Geometry, EndPoint=move_10.Geometry)
curve_curve = CurveCurve(CurveA=arc_3pt_2.Arc, CurveB=line, UseTasks=True)  # -> Points, ParamsA, ParamsB
curve_curve_2 = CurveCurve(CurveA=arc_3pt.Arc, CurveB=line_2)  # -> Points, ParamsA, ParamsB
vector_2pt_7 = Vector2Pt(PointA=curve_curve_2.Points, PointB=move_7.Geometry, Unitize=False)  # -> Vector, Length
vector_2pt_8 = Vector2Pt(PointA=curve_curve.Points, PointB=move_8.Geometry, Unitize=False)  # -> Vector, Length
move_11 = Move(Geometry=curve_4, Motion=sort_points.Points)  # -> Geometry, Transform
move_12 = Move(Geometry=arc_3pt.Arc, Motion=vector_2pt_7.Vector)  # -> Geometry, Transform
unit_z_5 = UnitZ(Factor=number)
move_13 = Move(Geometry=arc_3pt_2.Arc, Motion=vector_2pt_8.Vector)  # -> Geometry, Transform
unit_z_6 = UnitZ(Factor=number)
curve_10 = Curve(curve_2)
move_14 = Move(Geometry=move_12.Geometry, Motion=unit_z_5)  # -> Geometry, Transform
move_15 = Move(Geometry=move_13.Geometry, Motion=unit_z_6)  # -> Geometry, Transform
unit_z_7 = UnitZ(Factor=5000)
extend_curve = ExtendCurve(Curve=curve_10, Type=0, Start=100, End=100)
extrude_along = ExtrudeAlong(Base=move_11.Geometry, Curve=extend_curve)
extrude_3 = Extrude(Base=extend_curve, Direction=unit_z_7)
loft = Loft(
    Curves=[move_14.Geometry, move_15.Geometry],
    Options={Adjust=False, Closed=False, LoftEnds=0, LoftSimp=0, LoftType=0, Rebuild=10, Refit=0.01})
cap_holes_3 = CapHoles(Brep=extrude_along)
extrude_4 = Extrude(Base=loft, Direction=unit_z_3)
surface = Surface(curve)
solid_difference = SolidDifference(BrepsA=simplify(flatten(extrude_4)), BrepsB=simplify(flatten(extrude_3)))
area = Area(Geometry=surface)  # -> Area, Centroid
extrude_5 = Extrude(Base=surface, Direction=unit_z_7)
unit_z_8 = UnitZ(Factor=-100)
move_16 = Move(Geometry=extrude_5, Motion=unit_z_8)  # -> Geometry, Transform
brep = Brep(solid_difference)
solid_intersection = SolidIntersection(BrepsA=brep, BrepsB=move_16.Geometry)
unit_z_9 = UnitZ(Factor=-3000)
scale_3 = Scale(Geometry=surface, Center=area.Centroid, Factor=10)  # -> Geometry, Transform
extrude_6 = Extrude(Base=scale_3.Geometry, Direction=unit_z_9)
solid_difference_2 = SolidDifference(BrepsA=solid_intersection, BrepsB=extrude_6)
solid_difference_3 = SolidDifference(BrepsA=solid_difference_2, BrepsB=cap_holes_3)

# ---- group: OUTPUT
morph_settings = MorphSettings(BuildingMaterial=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, Layer=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)
morph_solid = MorphSolid(Synchronize=szinkron, Mesh=solid_difference_3, MorphSettings=morph_settings)

# ==== cluster Tween2P
point_a = ClusterInput()
point_b = ClusterInput()
factor = ClusterInput()
point_a_2 = Point(point_a)
point_b_2 = Point(point_b)
factor_2 = Number(factor)
vector_2pt = Vector2Pt(PointA=point_a_2, PointB=point_b_2, Unitize=False)  # -> Vector, Length
multiplication = Multiplication(A=vector_2pt.Vector, B=factor_2)
move = Move(Geometry=point_a_2, Motion=multiplication)  # -> Geometry, Transform
tween = Point(move.Geometry)
tween_2 = ClusterOutput(tween)

# ==== cluster FirstLast
list = ClusterInput()
list_2 = Data(list)
list_item = ListItem(List=list_2, Index=0, Wrap=True)  # -> Item1, Item
first_value = Data(list_item.Item)
last_value = Data(list_item.Item1)
first_value_2 = ClusterOutput(first_value)
last_value_2 = ClusterOutput(last_value)

# ==== cluster IPEBEAM
file_path = ClusterInput()
file_path_2 = FilePath(file_path)
read_file = ReadFile(File=file_path_2, PerLineParse=True)
split_list = SplitList(List=read_file, Index=1)  # -> ListA, ListB
text_split = TextSplit(Text=split_list.ListB, Separators=",")
ipe_profile = ClusterInput()
ipe_profile_2 = Text(ipe_profile)
list_item = ListItem(List=text_split, Index=1, Wrap=True)  # -> flatten(Item)
panel = Panel(text_split)
b = ListItem(List=text_split, Index=3, Wrap=True)  # -> flatten(Item)
s = ListItem(List=text_split, Index=4, Wrap=True)  # -> flatten(Item)
t = ListItem(List=text_split, Index=5, Wrap=True)  # -> flatten(Item)
h = ListItem(List=text_split, Index=2, Wrap=True)  # -> flatten(Item)
member_index = MemberIndex(Set=list_item, Member=ipe_profile_2)  # -> Index, Count
list_item_2 = ListItem(List=h, Index=member_index.Index, Wrap=True)  # -> flatten(Item)
list_item_3 = ListItem(List=s, Index=member_index.Index, Wrap=True)  # -> flatten(Item)
list_item_4 = ListItem(List=t, Index=member_index.Index, Wrap=True)  # -> flatten(Item)
list_item_5 = ListItem(List=b, Index=member_index.Index, Wrap=True)  # -> flatten(Item)
division = Division(A=list_item_5, B=2)
division_2 = Division(A=list_item_3, B=2)
division_3 = Division(A=list_item_4, B=10)
addition = Addition(A=division, B=division_2)
subtraction = Subtraction(A=division, B=division_2)
subtraction_2 = Subtraction(A=list_item_2, B=list_item_4)
construct_point = ConstructPoint(XCoordinate=0, YCoordinate=0, ZCoordinate=0)
construct_point_2 = ConstructPoint(XCoordinate=list_item_5, YCoordinate=0, ZCoordinate=0)
construct_point_3 = ConstructPoint(XCoordinate=list_item_5, YCoordinate=0, ZCoordinate=list_item_4)
construct_point_4 = ConstructPoint(XCoordinate=addition, YCoordinate=0, ZCoordinate=list_item_4)
construct_point_5 = ConstructPoint(XCoordinate=list_item_5, YCoordinate=0, ZCoordinate=subtraction_2)
construct_point_6 = ConstructPoint(XCoordinate=addition, YCoordinate=0, ZCoordinate=subtraction_2)
construct_point_7 = ConstructPoint(XCoordinate=list_item_5, YCoordinate=0, ZCoordinate=list_item_2)
construct_point_8 = ConstructPoint(XCoordinate=0, YCoordinate=0, ZCoordinate=list_item_2)
construct_point_9 = ConstructPoint(XCoordinate=0, YCoordinate=0, ZCoordinate=subtraction_2)
construct_point_10 = ConstructPoint(XCoordinate=subtraction, YCoordinate=0, ZCoordinate=subtraction_2)
construct_point_11 = ConstructPoint(XCoordinate=subtraction, YCoordinate=0, ZCoordinate=list_item_4)
construct_point_12 = ConstructPoint(XCoordinate=0, YCoordinate=0, ZCoordinate=list_item_4)
construct_point_13 = ConstructPoint(XCoordinate=0, YCoordinate=0, ZCoordinate=0)
negative = Negative(Value=division)
polyline = PolyLine(
    Vertices=[construct_point, construct_point_2, construct_point_3, construct_point_4, construct_point_6, construct_point_5, construct_point_7, construct_point_8, construct_point_9, construct_point_10, construct_point_11, construct_point_12, construct_point_13],
    Closed=False)
unit_x = UnitX(Factor=negative)
move = Move(Geometry=polyline, Motion=unit_x)  # -> Geometry, Transform
t_talpmagasság_cm = Number(division_3)
profil = Curve(move.Geometry)
profil_2 = ClusterOutput(profil)
t_talpmagasság_cm_2 = ClusterOutput(t_talpmagasság_cm)

# ==== cluster GenericIBeam
h_magasság = ClusterInput()
s_vastagság = ClusterInput()
t_talpmagasság = ClusterInput()
b_szélesség = ClusterInput()
t_talpmagasság_2 = Number(t_talpmagasság)
h_magasság_2 = Number(h_magasság)
b_szélesség_2 = Number(b_szélesség)
s_vastagság_2 = Number(s_vastagság)
division = Division(A=b_szélesség_2, B=2)
division_2 = Division(A=s_vastagság_2, B=2)
division_3 = Division(A=t_talpmagasság_2, B=10)
addition = Addition(A=division, B=division_2)
subtraction = Subtraction(A=division, B=division_2)
subtraction_2 = Subtraction(A=h_magasság_2, B=t_talpmagasság_2)
construct_point = ConstructPoint(XCoordinate=0, YCoordinate=0, ZCoordinate=0)
construct_point_2 = ConstructPoint(XCoordinate=b_szélesség_2, YCoordinate=0, ZCoordinate=0)
construct_point_3 = ConstructPoint(XCoordinate=b_szélesség_2, YCoordinate=0, ZCoordinate=t_talpmagasság_2)
construct_point_4 = ConstructPoint(XCoordinate=addition, YCoordinate=0, ZCoordinate=t_talpmagasság_2)
construct_point_5 = ConstructPoint(XCoordinate=b_szélesség_2, YCoordinate=0, ZCoordinate=subtraction_2)
construct_point_6 = ConstructPoint(XCoordinate=addition, YCoordinate=0, ZCoordinate=subtraction_2)
construct_point_7 = ConstructPoint(XCoordinate=b_szélesség_2, YCoordinate=0, ZCoordinate=h_magasság_2)
construct_point_8 = ConstructPoint(XCoordinate=0, YCoordinate=0, ZCoordinate=h_magasság_2)
construct_point_9 = ConstructPoint(XCoordinate=0, YCoordinate=0, ZCoordinate=subtraction_2)
construct_point_10 = ConstructPoint(XCoordinate=subtraction, YCoordinate=0, ZCoordinate=subtraction_2)
construct_point_11 = ConstructPoint(XCoordinate=subtraction, YCoordinate=0, ZCoordinate=t_talpmagasság_2)
construct_point_12 = ConstructPoint(XCoordinate=0, YCoordinate=0, ZCoordinate=t_talpmagasság_2)
construct_point_13 = ConstructPoint(XCoordinate=0, YCoordinate=0, ZCoordinate=0)
negative = Negative(Value=division)
polyline = PolyLine(
    Vertices=[construct_point, construct_point_2, construct_point_3, construct_point_4, construct_point_6, construct_point_5, construct_point_7, construct_point_8, construct_point_9, construct_point_10, construct_point_11, construct_point_12, construct_point_13],
    Closed=False)
unit_x = UnitX(Factor=negative)
move = Move(Geometry=polyline, Motion=unit_x)  # -> Geometry, Transform
t_talpmagasság_cm = Number(division_3)
profil = Curve(move.Geometry)
profil_2 = ClusterOutput(profil)
t_talpmagasság_cm_2 = ClusterOutput(t_talpmagasság_cm)

# ==== cluster Cluster
file_path = FilePath("Q:\BIM_management\10_BIMgoodies\Poroszsüveg_generátor\ParallelFlangeCSV.csv")
read_file = ReadFile(File=file_path, PerLineParse=True)
split_list = SplitList(List=read_file, Index=1)  # -> ListA, ListB
text_split = TextSplit(Text=split_list.ListB, Separators=",")
text = ClusterInput()
list_item = ListItem(List=text_split, Index=1, Wrap=True)  # -> flatten(Item)
text_2 = Text(text)
h = ListItem(List=text_split, Index=2, Wrap=True)  # -> flatten(Item)
b = ListItem(List=text_split, Index=3, Wrap=True)  # -> flatten(Item)
s = ListItem(List=text_split, Index=4, Wrap=True)  # -> flatten(Item)
t = ListItem(List=text_split, Index=5, Wrap=True)  # -> flatten(Item)
member_index = MemberIndex(Set=list_item, Member=text_2)  # -> Index, Count
list_item_2 = ListItem(List=h, Index=member_index.Index, Wrap=True)  # -> flatten(Item)
list_item_3 = ListItem(List=s, Index=member_index.Index, Wrap=True)  # -> flatten(Item)
list_item_4 = ListItem(List=t, Index=member_index.Index, Wrap=True)  # -> flatten(Item)
list_item_5 = ListItem(List=b, Index=member_index.Index, Wrap=True)  # -> flatten(Item)
addition = Addition(B=list_item_3)
subtraction = Subtraction(A=list_item_2, B=list_item_4)
construct_point = ConstructPoint(XCoordinate=0, YCoordinate=0, ZCoordinate=0)
construct_point_2 = ConstructPoint(XCoordinate=list_item_5, YCoordinate=0, ZCoordinate=0)
construct_point_3 = ConstructPoint(XCoordinate=list_item_5, YCoordinate=0, ZCoordinate=list_item_4)
construct_point_4 = ConstructPoint(XCoordinate=addition, YCoordinate=0, ZCoordinate=list_item_4)
construct_point_5 = ConstructPoint(XCoordinate=addition, YCoordinate=0, ZCoordinate=subtraction)
construct_point_6 = ConstructPoint(XCoordinate=list_item_5, YCoordinate=0, ZCoordinate=subtraction)
construct_point_7 = ConstructPoint(XCoordinate=list_item_5, YCoordinate=0, ZCoordinate=list_item_2)
construct_point_8 = ConstructPoint(XCoordinate=0, YCoordinate=0, ZCoordinate=list_item_2)
construct_point_9 = ConstructPoint(XCoordinate=0, YCoordinate=0, ZCoordinate=0)
division = Division(A=list_item_5, B=10)
division_2 = Division(A=list_item_4, B=10)
polyline = PolyLine(
    Vertices=[construct_point, construct_point_2, construct_point_3, construct_point_4, construct_point_5, construct_point_6, construct_point_7, construct_point_8, construct_point_9],
    Closed=False)
t_talpmagasság_cm = Number(division_2)
szélesség_cm = Number(division)
profil = Curve(polyline)
profil_2 = ClusterOutput(profil)
t_talpmagasság_cm_2 = ClusterOutput(t_talpmagasság_cm)
szélesség_cm_2 = ClusterOutput(szélesség_cm)
