# Grasshopper definition Zsaluzás.ghx (Grasshopper 1.0.7)
# plug-ins: Grasshopper-ARCHICAD Live Connection built for Rhinoceros 7, LunchBox

# ---- group: Input
a_legalsó_slab_aljzatbeton_e = BooleanToggle(False)
column = Column(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)
slab = Slab(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)
beam = Beam([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])
wall = Wall([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])
roof = Roof([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])

# ----
deconstruct_wall = DeconstructWall(
    Wall=wall,
    SurfaceType0_SurfaceType=(1, 0, 0),
    SurfaceType1_ParamName="Reference Side Surfaces",
    SurfaceType1_SurfaceType=(1, 0, 0),
    SurfaceType2_SurfaceType=(1, 0, 0),
    SurfaceType3_SurfaceType=(1, 0, 0),
    SurfaceType4_SurfaceType=(1, 0, 0),
    SurfaceType5_SurfaceType=(1, 0, 0),
    SurfaceType6_SurfaceType=(1, 0, 0),
    SurfaceType7_SurfaceType=(1, 0, 0),
    SurfaceType8_SurfaceType=(1, 0, 0),
    SurfaceType9_SurfaceType=(1, 0, 0),
    SurfaceType10_ParamName="Wall Opening Side Surfaces",
    SurfaceType10_SurfaceType=(1, 0, 0),
    SurfaceType11_SurfaceType=(1, 0, 0))  # -> Curve, Brep, WallSettings, ReferenceSideSurfaces, flatten(WallOpeningSideSurfaces)
deconstruct_beam = DeconstructBeam(
    Beam=beam,
    SurfaceType0_SurfaceType=(1, 0, 0),
    SurfaceType1_SurfaceType=(1, 0, 0),
    SurfaceType2_SurfaceType=(1, 0, 0),
    SurfaceType3_SurfaceType=(1, 0, 0),
    SurfaceType4_SurfaceType=(1, 0, 0),
    SurfaceType5_ParamName="Bottom Surfaces",
    SurfaceType5_SurfaceType=(1, 0, 0),
    SurfaceType6_SurfaceType=(1, 0, 0),
    SurfaceType7_SurfaceType=(1, 0, 0),
    SurfaceType8_SurfaceType=(1, 0, 0),
    SurfaceType9_SurfaceType=(1, 0, 0))  # -> Curve, Brep, BeamSettings, BottomSurfaces
deconstruct_slab = DeconstructSlab(
    Slab=slab,
    SurfaceType0_SurfaceType=(1, 0, 0),
    SurfaceType1_ParamName="Top Surfaces",
    SurfaceType1_SurfaceType=(1, 0, 0),
    SurfaceType2_SurfaceType=(1, 0, 0),
    SurfaceType3_SurfaceType=(1, 0, 0),
    SurfaceType4_SurfaceType=(1, 0, 0),
    SurfaceType5_SurfaceType=(1, 0, 0))  # -> Polygon, Brep, SlabSettings, TopSurfaces
check_validity = Button()
deconstruct_roof = DeconstructRoof(
    RoofSinglePlane=roof,
    SurfaceType0_SurfaceType=(1, 0, 0),
    SurfaceType1_SurfaceType=(1, 0, 0),
    SurfaceType2_SurfaceType=(1, 0, 0),
    SurfaceType3_SurfaceType=(1, 0, 0),
    SurfaceType4_SurfaceType=(1, 0, 0),
    SurfaceType5_SurfaceType=(1, 0, 0),
    SurfaceType6_SurfaceType=(1, 0, 0),
    SurfaceType7_ParamName="Eaves Surfaces",
    SurfaceType7_SurfaceType=(1, 0, 0),
    SurfaceType8_SurfaceType=(1, 0, 0),
    SurfaceType9_SurfaceType=(1, 0, 0),
    SurfaceType10_SurfaceType=(1, 0, 0),
    SurfaceType11_SurfaceType=(1, 0, 0),
    SurfaceType12_SurfaceType=(1, 0, 0),
    SurfaceType13_SurfaceType=(1, 0, 0),
    SurfaceType14_SurfaceType=(1, 0, 0),
    SurfaceType15_SurfaceType=(1, 0, 0),
    SurfaceType16_SurfaceType=(1, 0, 0),
    SurfaceType17_SurfaceType=(1, 0, 0))  # -> Polygon, Brep, RoofSettings, EavesSurfaces
deconstruct_column = DeconstructColumn(
    Column=column,
    SurfaceType0_SurfaceType=(1, 0, 0),
    SurfaceType1_SurfaceType=(1, 0, 0),
    SurfaceType2_ParamName="Bottom Surfaces",
    SurfaceType2_SurfaceType=(1, 0, 0),
    SurfaceType3_SurfaceType=(1, 0, 0),
    SurfaceType4_SurfaceType=(1, 0, 0),
    SurfaceType5_SurfaceType=(1, 0, 0),
    SurfaceType6_SurfaceType=(1, 0, 0),
    SurfaceType7_SurfaceType=(1, 0, 0),
    SurfaceType8_SurfaceType=(1, 0, 0))  # -> AnchorPoint, EndPoint, simplify(Brep), ColumnSettings, BottomSurfaces
extract_beam_settings = ExtractBeamSettings(BeamSettings=deconstruct_beam.BeamSettings)  # -> Structure, BuildingMaterial, Profile, Height, Width, AxisOffset, degrees(ProfileRotation), Layer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
extract_wall_settings = ExtractWallSettings(WallSettings=deconstruct_wall.WallSettings)  # -> Structure, BuildingMaterial, Composite, Profile, Height, Thickness, ThicknessTrapezoid, degrees(OutsideSlantAngle)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
extract_slab_settings = ExtractSlabSettings(SlabSettings=deconstruct_slab.SlabSettings)  # -> Structure, BuildingMaterial, Composite, Thickness, degrees(EdgeAngle), ReferencePlane, Layer, HomeStory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
area = Area(Geometry=deconstruct_wall.WallOpeningSideSurfaces)  # -> flatten(Area), Centroid
negative = Negative(Value=extract_slab_settings.Thickness)
number = Number(area.Area)
sort_duplicate_breps = SortDuplicateBreps(Breps=deconstruct_roof.Brep)  # -> UniqueBreps, Indices
mass_addition = MassAddition(Input=number)  # -> Result, PartialResults
unit_z = UnitZ(Factor=negative)
unit_z_2 = UnitZ(Factor=extract_beam_settings.Height)
# Beam
cleanup_breps = CleanupBreps(brep=deconstruct_beam.BottomSurfaces, extrusion_direction=unit_z_2)
# Wall
cleanup_breps_2 = CleanupBreps(brep=deconstruct_wall.ReferenceSideSurfaces, value=extract_wall_settings.Thickness)
# Roof
brep = Brep(flatten(sort_duplicate_breps.UniqueBreps))
# Slab
cleanup_breps_3 = CleanupBreps(brep=deconstruct_slab.TopSurfaces, extrusion_direction=unit_z)
# Column
brep_2 = Brep(flatten(deconstruct_column.Brep))
path_mapper = PathMapper(brep, source="{A}(i)", target="{4}(i)")
path_mapper_2 = PathMapper(brep_2, source="{A}(i)", target="{3}(i)")
path_mapper_3 = PathMapper(cleanup_breps_3, source="{A}(i)", target="{0}(i)")
path_mapper_4 = PathMapper(cleanup_breps, source="{A}(i)", target="{1}(i)")
path_mapper_5 = PathMapper(cleanup_breps_2, source="{A}(i)", target="{2}(i)")

# ---- group: Remove inner surfaces
brep_3 = Brep([path_mapper_4, path_mapper_3, path_mapper_5, path_mapper_2, path_mapper])
solid_union = SolidUnion(Breps=flatten(brep_3))
deconstruct_brep = DeconstructBrep(Brep=brep_3)  # -> Faces, Edges, Vertices
deconstruct_brep_2 = DeconstructBrep(Brep=solid_union)  # -> flatten(Faces), Edges, Vertices
area_2 = Area(Geometry=deconstruct_brep_2.Faces)  # -> Area, Centroid
cluster = Cluster(list=deconstruct_brep.Faces, item=area_2.Centroid)
insert_items = InsertItems(List=deconstruct_brep.Faces, Item=area_2.Centroid, Indices=0, Wrap=True)
list_length = ListLength(List=area_2.Centroid)
split_list = SplitList(List=insert_items, Index=list_length)  # -> ListA, ListB
surface = Surface(graft(deconstruct_brep.Faces))
surface_2 = Surface(deconstruct_brep_2.Faces)
trim_tree = TrimTree(Tree=split_list.ListA, Depth=2)
surface_closest_point = SurfaceClosestPoint(Point=trim_tree, Surface=surface)  # -> Point, UVPoint, Distance
smaller_than = SmallerThan(FirstNumber=surface_closest_point.Distance, SecondNumber=0.1)  # -> SmallerThan, OrEqualTo
cull_pattern = CullPattern(List=surface_2, CullPattern=smaller_than.SmallerThan)
path_mapper_6 = PathMapper(cull_pattern, source="{A;B;C}(i)", target="{A;B}(C)")

# ---- group: Validate
data = Data(flatten(smaller_than.SmallerThan))
sort_list = SortList(Keys=data)  # -> Keys, ValuesValuesA
mass_addition_2 = MassAddition(Input=sort_list.Keys)  # -> Result, PartialResults
equality = Equality(FirstNumber=list_length, SecondNumber=mass_addition_2.Result)  # -> Equality, Inequality
boolean = Boolean(equality.Equality)
panel = Panel(boolean)
gate_not = GateNot(A=boolean)
integer = Integer(255)
multiplication = Multiplication(A=integer, B=boolean)
multiplication_2 = Multiplication(A=integer, B=gate_not)
average = Average(Input=area_2.Centroid)
bounding_box = BoundingBox(Content=flatten(brep_3), Plane=PlaneXY(0, 0, 0), UnionBox=True)  # -> Box, Box_2
colour_rgb = ColourRGB(Alpha=255, Red=multiplication_2, Green=multiplication, Blue=0)
deconstruct_box = DeconstructBox(Box=bounding_box.Box)  # -> Plane, X, Y, Z
deconstruct = Deconstruct(Point=average)  # -> XComponent, YComponent, ZComponent
number_2 = Number(deconstruct_box.Z)
multiplication_3 = Multiplication(A=number_2, B=1.5)
construct_point = ConstructPoint(XCoordinate=deconstruct.XComponent, YCoordinate=deconstruct.YComponent, ZCoordinate=multiplication_3)
construct_point_2 = ConstructPoint(XCoordinate=deconstruct.XComponent, YCoordinate=deconstruct.YComponent, ZCoordinate=multiplication_3)
multiplication_4 = Multiplication(A=check_validity, B=1200)
cloud_display = CloudDisplay(Points=[construct_point, construct_point_2], Colours=colour_rgb, Size=multiplication_4, SpriteType=0)

# ----
list_length_2 = ListLength(List=path_mapper_3)
brep_4 = Brep(path_mapper_6)
series = Series(Start=0, Step=1, Count=list_length_2)
concatenate = Concatenate(Fragment_A="{0;", Fragment_B=series, A="}")
trim_tree_2 = TrimTree(Tree=brep_4, Depth=1)
tree_branch = TreeBranch(Tree=brep_4, Path=concatenate, MaintainPaths=True)
cullnull = CullNulls(item=tree_branch)
bounding_box_2 = BoundingBox(Content=cullnull, Plane=PlaneXY(0, 0, 0), UnionBox=True)  # -> Box, Box_2
volume = Volume(Geometry=flatten(bounding_box_2.Box))  # -> Volume, Centroid
deconstruct_2 = Deconstruct(Point=volume.Centroid)  # -> XComponent, YComponent, ZComponent
sort_list_2 = SortList(Keys=deconstruct_2.ZComponent, ValuesValuesA=series)  # -> Keys, ValuesValuesA
firstslab = GhPythonScript(isSlab=a_legalsó_slab_aljzatbeton_e)  # -> a; inputs isSlab: Boolean
# ---------- firstslab: Python ----------
__author__ = "samu.karli"
__version__ = "2022.05.18"

import rhinoscriptsyntax as rs

a = 1 if isSlab else 0
# ---------- end firstslab ----------
split_list_2 = SplitList(List=sort_list_2.ValuesValuesA, Index=firstslab)  # -> ListA, ListB

# ---- group: Slab / 1st slab
concatenate_2 = Concatenate(Fragment_A="{0;", Fragment_B=split_list_2.ListA, A="}")
tree_branch_2 = TreeBranch(Tree=brep_4, Path=concatenate_2, MaintainPaths=True)

# ---- group: Slab / upper slabs
concatenate_3 = Concatenate(Fragment_A="{0;", Fragment_B=split_list_2.ListB, A="}")
tree_branch_3 = TreeBranch(Tree=brep_4, Path=concatenate_3, MaintainPaths=True)

# ----
tree_branch_4 = TreeBranch(Tree=trim_tree_2, Path="{4}", MaintainPaths=True)
split_tree = SplitTree(Data=path_mapper_6, Masks=flatten("{(1); (?)}"))  # -> Positive, Negative
split_tree_2 = SplitTree(Data=path_mapper_6, Masks=flatten("{(2, 3); (?)}"))  # -> Positive, Negative
brep_5 = Brep(tree_branch_4)
remove_bottom_surfaces = GhPythonScript(surf=[tree_branch_2, split_tree_2.Positive])  # -> out, List; inputs surf: tree of Brep
# ---------- remove_bottom_surfaces: Python ----------
__author__ = "samu.karli"
__version__ = "2022.04.27"

hor__ = "samu.karli"
__version__ = "2022.04.27"

epsilon = 0.01

from Rhino import Geometry
import sys
import pprint
from Grasshopper import DataTree as Tree


def isNotVertical(p_):
    return not p_.NormalAt(0,0).IsParallelTo(Geometry.Vector3d(0,0,1)) in {1,-1}

List = Tree[object]()

for i in range(surf.BranchCount):
    branchList = surf.Branch(i)
    branchPath = surf.Path(i)

    print (branchPath)

    zBottom = sys.float_info.max

    for brep in branchList:
        try:
            item = brep.Surfaces[0]
            zBottom = min(zBottom, Geometry.AreaMassProperties.Compute(item).Centroid.Z)
        except (TypeError, AttributeError):
            continue
    
    for brep in branchList:
        try:
            print(brep)
            item = brep.Surfaces[0]
            if Geometry.AreaMassProperties.Compute(item).Centroid.Z > zBottom + epsilon or isNotVertical(item):
                List.Add(brep, branchPath)
        except (TypeError, AttributeError):
            continue
# ---------- end remove_bottom_surfaces ----------
remove_top_surfaces = GhPythonScript(surf=[split_tree.Positive, tree_branch_3, remove_bottom_surfaces.List])  # -> out, List; inputs surf: tree
# ---------- remove_top_surfaces: Python ----------
__author__ = "samu.karli"
__version__ = "2022.04.27"

hor__ = "samu.karli"
__version__ = "2022.04.27"

epsilon = 0.01

from Rhino import Geometry
import sys
import pprint
from Grasshopper import DataTree as Tree


def isNotVertical(p_):
    return not p_.NormalAt(0,0).IsParallelTo(Geometry.Vector3d(0,0,1)) in {1,-1}

List = Tree[object]()

for i in range(surf.BranchCount):
    branchList = surf.Branch(i)
    branchPath = surf.Path(i)

    zTop = -sys.float_info.max

    for brep in branchList:
        try:
            item = brep.Surfaces[0]
            zTop = max(zTop, Geometry.AreaMassProperties.Compute(item).Centroid.Z)
        except (TypeError, AttributeError):
            continue
    
    for brep in branchList:
        try:
            if isinstance(brep, Geometry.Brep):
                item = brep.Surfaces[0]
                if Geometry.AreaMassProperties.Compute(item).Centroid.Z < zTop - epsilon or isNotVertical(item):
                    List.Add(brep, branchPath)
        except (TypeError, AttributeError):
            continue
# ---------- end remove_top_surfaces ----------
trim_tree_3 = TrimTree(Tree=remove_top_surfaces.List, Depth=1)
cullnull_2 = CullNulls(item=[brep_5, trim_tree_3])
explode_tree = ExplodeTree(Data=cullnull_2)  # -> Branch0, Branch1, Branch2, Branch3, Branch4
panel_2 = Panel(trim_tree_3)
area_3 = Area(Geometry=cullnull_2)  # -> Area, Centroid
create_material = CreateMaterial(Diffuse=RGB(0, 80, 122), Specular=RGB(255, 255, 255), Emission=RGB(0, 0, 0), Transparency=0, Shine=0)
create_material_2 = CreateMaterial(Diffuse=RGB(240, 156, 31), Specular=RGB(255, 255, 255), Emission=RGB(0, 0, 0), Transparency=0, Shine=0)
create_material_3 = CreateMaterial(Diffuse=RGB(125, 24, 24), Specular=RGB(255, 255, 255), Emission=RGB(0, 0, 0), Transparency=0, Shine=0)
create_material_4 = CreateMaterial(Diffuse=RGB(169, 184, 61), Specular=RGB(255, 255, 255), Emission=RGB(0, 0, 0), Transparency=0, Shine=0)
create_material_5 = CreateMaterial(Diffuse=RGB(161, 61, 184), Specular=RGB(255, 255, 255), Emission=RGB(0, 0, 0), Transparency=0, Shine=0)
mass_addition_3 = MassAddition(Input=area_3.Area)  # -> Result, PartialResults
slab_2 = Panel("1")
slab_3 = Panel("m2")
division = Division(A=mass_addition_3.Result, B=slab_2)
custom_preview = CustomPreview(Geometry=explode_tree.Branch1, Material=create_material_2)
custom_preview_2 = CustomPreview(Geometry=explode_tree.Branch2, Material=create_material_3)
custom_preview_3 = CustomPreview(Geometry=explode_tree.Branch3, Material=create_material_4)
custom_preview_4 = CustomPreview(Geometry=explode_tree.Branch4, Material=create_material_5)
custom_preview_5 = CustomPreview(Geometry=explode_tree.Branch0, Material=create_material)
concatenate_4 = Concatenate(FragmentA=division, FragmentB=slab_3, JoinSeparator=" ")
explode_tree_2 = ExplodeTree(Data=concatenate_4)  # -> Branch0, Branch1, Branch2, Branch3, Branch4

# ---- group: OUTPUT
slab_4 = Panel(explode_tree_2.Branch0)
column_2 = Panel(explode_tree_2.Branch3)
roof_2 = Panel(explode_tree_2.Branch4)
opening = Panel(mass_addition.Result)
beam_2 = Panel(explode_tree_2.Branch1)
wall_2 = Panel(explode_tree_2.Branch2)

# ==== cluster CullNulls: Culls null items from a list
item = ClusterInput()
null_item = NullItem(Item=item)  # -> NullFlags, InvalidFlags, Description
gate_not = GateNot(A=null_item.NullFlags)
cull_pattern = CullPattern(List=item, CullPattern=gate_not)
list = ClusterOutput(cull_pattern)

# ==== cluster CleanupBreps
value = ClusterInput()
extrusion_direction = ClusterInput()
brep = ClusterInput()
brep_edges = BrepEdges(Brep=brep)  # -> simplify(Naked), Interior, NonManifold
boundary_surfaces = BoundarySurfaces(Edges=brep_edges.Naked)
brep_join = BrepJoin(Breps=boundary_surfaces)  # -> Breps, Closed
brep_edges_2 = BrepEdges(Brep=brep_join.Breps)  # -> simplify(Naked), Interior, NonManifold
negative = Negative(Value=value)
boundary_surfaces_2 = BoundarySurfaces(Edges=brep_edges_2.Naked)
face_normals = FaceNormals(Mesh=boundary_surfaces_2)  # -> Centers, Normals
amplitude = Amplitude(Vector=face_normals.Normals, Amplitude=negative)
extrude = Extrude(Base=boundary_surfaces_2, Direction=[amplitude, extrusion_direction])
sort_duplicate_breps = SortDuplicateBreps(Breps=extrude)  # -> UniqueBreps, Indices
brep_2 = Brep(flatten(sort_duplicate_breps.UniqueBreps))
brep_3 = ClusterOutput(brep_2)

# ==== cluster Cluster
list = ClusterInput()
item = ClusterInput()
insert_items = InsertItems(List=list, Item=item, Indices=0, Wrap=True)
list_2 = ClusterOutput(insert_items)
